# Grasshopper definition Display Mesh.gh (Grasshopper 0.9.76)
# plug-ins: Volvox

number_slider = Slider(50, range=0..100)
cir = Circle(Plane=PlaneXY(0, 0, 0), Radius=1)
divide = DivideCurve(Curve=cir, Count=Slider(6, range=0..10), Kinks=False)  # -> Points, Tangents, Parameters
cgrid = CloudGrid(Plane=PlaneXY(0, 0, 0), Size=1, ExtentX=number_slider, ExtentY=number_slider, ExtentZ=number_slider)
panel = Panel("""20
10
30""")
pop3d = Populate3D(Region=cgrid, Count=Slider(3, range=0..10), Seed=1)
del = DelaunayMesh(Points=divide.Points, Plane=PlaneXY(0, 0, 0))
vb = VBScript(
    points=cgrid,
    cp=pop3d,
    cpval=panel,
    msh=del,
    x=Slider(1, range=0..100),
    y=Slider(20, range=0..100),
    Reference="C:\Users\mzwi\AppData\Roaming\Grasshopper\Libraries\Volvox\Volvox_Cloud.dll")  # -> out, A, B; inputs cp: list of Point3d, cpval: list, msh: Mesh
# ---------- vb: VB ----------
    Dim m() As  mesh = Nothing

    Dim pc As pointcloud = points
    ReDim m(pc.count - 1)

    Dim v(pc.count-1) As Double

    For i As Integer = 0 To pc.count - 1 Step 1
      Dim temp As mesh = msh.DuplicateMesh
      temp.Transform(transform.Translation(pc(i).location))
      m(i) = temp

      Dim thispoint As point3d = pc(i).location

      For j As Integer = 0 To cp.count - 1 Step 1
        Dim dist As Double = (x * thispoint.distanceto(cp(j))) / cpval(j)
        v(i) += (1 / (dist))
      Next
    Next

    Dim maxv As Double = Double.MinValue

    For i As Integer = 0 To v.length - 1 Step 1
      maxv = math.max(maxv, v(i))
    Next

    Dim denom As Double = 1 / (maxv + 1)
    Dim srt(99) as mesh

    For i As Integer = 0 To srt.length - 1 Step 1
      srt(i) = New mesh
    Next

    For i As Integer = 0 To m.length - 1 Step 1
      Dim thisv As Double = 99 * (1 - (math.Min(v(i), y) * denom))
      srt(thisv).append(m(i))
    Next

    a = srt
# ---------- end vb ----------
lng = ListLength(List=vb.A)
range = Range(Domain=Domain(0, 1), Steps=lng)
panel_2 = Panel(vb.A)
gradient = Gradient(
    LowerLimit=0,
    UpperLimit=1,
    Parameter=range,
    stops=[0.825: RGB(255, 255, 255), 0.954: RGBA(255, 255, 255, 0), 1: RGBA(219, 219, 219, 0)])
preview = CustomPreview(Geometry=vb.A, Shader=gradient)
