# Grasshopper definition logo.gh (Grasshopper 0.9.76)
# plug-ins: Squid, Weaverbird

yz = YZPlane(Origin=Point(0, 0, 0))
xz = XZPlane(Origin=Point(0, 0, 0))
yz_2 = YZPlane(Origin=Point(0, 0, 0))
xz_2 = XZPlane(Origin=Point(0, 0, 0))
wbicosahedron = WeaverbirdsMeshMeshIcosahedron(Plane=PlaneXY(0, 0, 0), Radius=5)
wbicosahedron_2 = WeaverbirdsMeshMeshIcosahedron(Plane=PlaneXY(0, 0, 0), Radius=5)
rotate = Rotate(Geometry=wbicosahedron, Angle=Slider(0.494, range=0..3.142), Plane=PlaneXY(0, 0, 0))  # -> Geometry, Transform
rotate_2 = Rotate(Geometry=wbicosahedron_2, Angle=Slider(0.494, range=0..3.142), Plane=PlaneXY(0, 0, 0))  # -> Geometry, Transform
rotate_3 = Rotate(Geometry=rotate.Geometry, Angle=Slider(0.249, range=0..3.142), Plane=yz)  # -> Geometry, Transform
rotate_4 = Rotate(Geometry=rotate_2.Geometry, Angle=Slider(0.249, range=0..3.142), Plane=yz_2)  # -> Geometry, Transform
rotate_5 = Rotate(Geometry=rotate_3.Geometry, Angle=Slider(0.714, range=0..3.142), Plane=xz)  # -> Geometry, Transform
wbcatmullclark = WeaverbirdsCatmullClarkSubdivision(MeshCurves=rotate_5.Geometry, Level=Slider(2, range=0..10), SmoothNakedEdges=1)
demesh = DeconstructMesh(Mesh=wbcatmullclark)  # -> Vertices, Faces, Colours, Normals
rotate_6 = Rotate(Geometry=rotate_4.Geometry, Angle=Slider(0.714, range=0..3.142), Plane=xz_2)  # -> Geometry, Transform
wbcatmullclark_2 = WeaverbirdsCatmullClarkSubdivision(MeshCurves=rotate_6.Geometry, Level=Slider(2, range=0..10), SmoothNakedEdges=1)
demesh_2 = DeconstructMesh(Mesh=wbcatmullclark_2)  # -> Vertices, Faces, Colours, Normals
line = LineSDL(Start=Point(0, 0, 0), Direction=demesh.Vertices, Length=Slider(10, range=0..10))
line_2 = LineSDL(Start=Point(0, 0, 0), Direction=demesh_2.Vertices, Length=Slider(10, range=0..10))
end = EndPoints(Curve=line)  # -> Start, End
end_2 = EndPoints(Curve=line_2)  # -> Start, End
pdecon = Deconstruct(Point=end.End)  # -> XComponent, YComponent, ZComponent
pdecon_2 = Deconstruct(Point=end_2.End)  # -> XComponent, YComponent, ZComponent
bnd = Bounds(Numbers=pdecon.ZComponent)
bnd_2 = Bounds(Numbers=pdecon_2.ZComponent)
remap = RemapNumbers(Value=pdecon.ZComponent, Source=bnd, Target="0.2 to .5")  # -> Mapped, Clipped
pt = ConstructPoint(XCoordinate=pdecon.XComponent, YCoordinate=pdecon.YComponent, ZCoordinate=0)
multiplication = Multiplication(A=remap.Mapped, B=Slider(0.6, range=0..1))
remap_2 = RemapNumbers(Value=pdecon_2.ZComponent, Source=bnd_2, Target="0.2 to .5")  # -> Mapped, Clipped
pt_2 = ConstructPoint(XCoordinate=pdecon_2.XComponent, YCoordinate=pdecon_2.YComponent, ZCoordinate=0)
multiplication_2 = Multiplication(A=remap_2.Mapped, B=Slider(0.6, range=0..1))
circle = Circle([{Plane=Plane(origin=(-5, 3, 0), x=(0.7071067812, -0.7071067812, 0), y=(0.7071067812, 0.7071067812, 0)), Radius=2.828427125}, {Plane=PlaneXY(0, -5, 0), Radius=2}, {Plane=Plane(origin=(5, 0, 0), x=(0.8320502943, -0.5547001962, 0), y=(0.5547001962, 0.8320502943, 0)), Radius=3.605551275}])
circle_2 = CircleCNR(Center=pt, Normal=Vector(0, 0, 1), Radius=multiplication)
circle_3 = CircleCNR(Center=pt, Normal=Vector(0, 0, 1), Radius=remap.Mapped)
circle_4 = Circle([{Plane=Plane(origin=(-5, 3, 0), x=(0.7071067812, -0.7071067812, 0), y=(0.7071067812, 0.7071067812, 0)), Radius=2.828427125}, {Plane=PlaneXY(0, -5, 0), Radius=2}, {Plane=Plane(origin=(5, 0, 0), x=(0.8320502943, -0.5547001962, 0), y=(0.5547001962, 0.8320502943, 0)), Radius=3.605551275}])
circle_5 = CircleCNR(Center=pt_2, Normal=Vector(0, 0, 1), Radius=multiplication_2)
circle_6 = CircleCNR(Center=pt_2, Normal=Vector(0, 0, 1), Radius=remap_2.Mapped)
rectangle = Rectangle(Plane=PlaneXY(0, 0, 0), XSize="-12 to 12", YSize="-12 to 12", Radius=0)  # -> Rectangle, Length
sort = SortList(Keys=remap.Mapped, ValuesA=circle_3)  # -> Keys, ValuesA
sort_2 = SortList(Keys=remap.Mapped, ValuesA=circle_2)  # -> Keys, ValuesA
rectangle_2 = Rectangle(Plane=PlaneXY(0, 0, 0), XSize="-12 to 12", YSize="-12 to 12", Radius=0)  # -> Rectangle, Length
sort_3 = SortList(Keys=remap_2.Mapped, ValuesA=circle_6)  # -> Keys, ValuesA
sort_4 = SortList(Keys=remap_2.Mapped, ValuesA=circle_5)  # -> Keys, ValuesA
draw = Draw(Curve=circle, Accuracy=-1, Fill=ColourSwatch(SwatchColor=RGBA(79, 143, 0, 89)))  # -> SquidInstr, Curve
draw_2 = Draw(Curve=sort_2.ValuesA, Accuracy=-1, Fill=ColourSwatch(SwatchColor=RGB(255, 255, 255)))  # -> SquidInstr, Curve
draw_3 = Draw(Curve=sort.ValuesA, Accuracy=-1, Fill=ColourSwatch(SwatchColor=RGB(0, 0, 0)))  # -> SquidInstr, Curve
draw_4 = Draw(Curve=circle_4, Accuracy=-1, Fill=ColourSwatch(SwatchColor=RGBA(79, 143, 0, 89)))  # -> SquidInstr, Curve
draw_5 = Draw(Curve=sort_4.ValuesA, Accuracy=-1, Fill=ColourSwatch(SwatchColor=RGB(255, 255, 255)))  # -> SquidInstr, Curve
draw_6 = Draw(Curve=sort_3.ValuesA, Accuracy=-1, Fill=ColourSwatch(SwatchColor=RGB(0, 0, 0)))  # -> SquidInstr, Curve
weave = Weave(Pattern=[0, 1], Stream0=draw_3.SquidInstr, Stream1=draw_2.SquidInstr, NullGaps=False)
clear = Clear(Color=RGB(255, 255, 255))
weave_2 = Weave(Pattern=[0, 1], Stream0=draw_6.SquidInstr, Stream1=draw_5.SquidInstr, NullGaps=False)
clear_2 = Clear(Color=RGB(255, 255, 255))
merge = Merge(Data1=flatten(clear), Data2=flatten(draw.SquidInstr), Data3=flatten(weave))
merge_2 = Merge(Data2=flatten(draw_4.SquidInstr), Data3=flatten(weave_2))
squid = Squid(BitmapR=rectangle.Rectangle, SquidInstr=merge, PPU=Slider(30, range=0..30), AA=True, autohide=False)
squid_2 = Squid(BitmapR=rectangle_2.Rectangle, SquidInstr=merge_2, PPU=Slider(30, range=0..30), AA=True, autohide=False)
rec = Rectangle({Plane=PlaneXY(0, 0, 0), Size=Domain2(u=0..24, v=0..24)})
image = Image(Bitmap=squid_2, Bounds=rec, Interpolate=3)
squid_3 = Squid(BitmapR=rec, SquidInstr=image, PPU=1, AA=True, autohide=False)
