# Grasshopper definition new icons.gh (Grasshopper 0.9.76)
# plug-ins: Squid, Starling

range = Range(Domain=Domain(0, 1), Steps=10)
gradient = Gradient(LowerLimit=0, UpperLimit=1, Parameter=range, stops=[0: RGB(255, 255, 255), 1: RGB(227, 227, 227)])
filll = FillLinear(Line=Line((2, -1, 0), (20, 25, 0)), Params=range, Colors=gradient)  # -> Fill, Points

geo = Geometry(<curve referenced from the Rhino model>)
geo_2 = Geometry(<curve referenced from the Rhino model>)
geo_3 = Geometry(<curve referenced from the Rhino model>)
outline = Outline(Color=ColourSwatch(SwatchColor=RGB(54, 54, 54)), Width=Slider(10, range=0..20))
outline_2 = Outline(Color=ColourSwatch(SwatchColor=RGB(79, 79, 79)), Width=Slider(10, range=0..10))
draw = Draw(Curve=geo, Accuracy=-1, Fill=ColourSwatch(SwatchColor=RGBA(244, 255, 125, 182)))  # -> SquidInstr, Curve
draw_2 = Draw(Curve=geo_2, Accuracy=-1, Outline=outline)  # -> SquidInstr, Curve
draw_3 = Draw(Curve=geo_3, Accuracy=-1, Outline=outline_2)  # -> SquidInstr, Curve

geo_4 = Geometry(<curve referenced from the Rhino model>)
vec = VectorXYZ(XComponent=Slider(-0.5, range=-10..10), YComponent=0, ZComponent=0)  # -> Vector, Length
draw_4 = Draw(Curve=geo_4, Accuracy=-1, Fill=ColourSwatch(SwatchColor=RGBA(0, 0, 0, 0)))  # -> SquidInstr, Curve
over = Overwrite(SquidInstr=draw_4.SquidInstr, Over=True)
pline = PolyLine(Vertices=[Point(238, 174, 0), Point(130, 282, 0), Point(263, 282, 0), Point(265, 188, 0)], Closed=True)
pline_2 = PolyLine(Vertices=[Point(233, 141, 0), Point(82, 292, 0), Point(245, 292, 0), Point(245, 154, 0)], Closed=True)
vec_2 = VectorXYZ(XComponent=Slider(11, range=-200..200), YComponent=Slider(0, range=-200..200), ZComponent=0)  # -> Vector, Length
move = Move(Geometry=pline_2, Motion=vec_2.Vector)  # -> Geometry, Transform
range_2 = Range(Domain=Domain(0, 1), Steps=10)
Z = UnitZ(Factor=1)
pline_3 = PolyLine(Vertices=[Point(238, 174, 0), Point(130, 282, 0), Point(263, 282, 0), Point(265, 188, 0)], Closed=True)
pline_4 = PolyLine(Vertices=[Point(233, 141, 0), Point(82, 292, 0), Point(245, 292, 0), Point(245, 154, 0)], Closed=True)
gradient_2 = Gradient(LowerLimit=0, UpperLimit=1, Parameter=range_2, stops=[0: RGB(255, 255, 255), 1: RGB(227, 227, 227)])
vec_3 = VectorXYZ(XComponent=Slider(11, range=-200..200), YComponent=Slider(0, range=-200..200), ZComponent=0)  # -> Vector, Length
move_2 = Move(Geometry=pline_4, Motion=vec_3.Vector)  # -> Geometry, Transform
range_3 = Range(Domain=Domain(0, 1), Steps=10)
filll_2 = FillLinear(Line=Line((2, -1, 0), (20, 25, 0)), Params=range_2, Colors=reverse(gradient_2))  # -> Fill, Points
Z_2 = UnitZ(Factor=1)
gradient_3 = Gradient(LowerLimit=0, UpperLimit=1, Parameter=range_3, stops=[0: RGB(255, 255, 255), 1: RGB(227, 227, 227)])
pline_5 = PolyLine(Vertices=[Point(50, 30, 0), Point(180, 30, 0)], Closed=False)

number_slider = Slider(0, range=0..100)
swatch = ColourSwatch(SwatchColor=RGB(255, 255, 255))
pline_6 = PolyLine(
    Vertices=[Point(75, 95, 0), Point(50, 95, 0), Point(50, 75, 0), Point(75, 75, 0), Point(50, 75, 0), Point(50, 55, 0), Point(75, 55, 0)],
    Closed=False)
pline_7 = PolyLine(
    Vertices=[Point(130, 95, 0), Point(95, 95, 0), Point(95, 75, 0), Point(130, 75, 0), Point(130, 55, 0), Point(95, 55, 0)],
    Closed=False)
pline_8 = PolyLine(Vertices=[Point(150, 95, 0), Point(175, 95, 0), Point(175, 55, 0)], Closed=False)
outlineex = OutlineEx(
    Color=RGB(0, 0, 0),
    Width=Slider(1, range=0..10),
    LineJoin=Slider(1, range=0..100),
    StartCap=number_slider,
    EndCap=number_slider,
    Dash="1",
    DashCap=1)
vec_4 = VectorXYZ(XComponent=Slider(0.4, range=-20..20), YComponent=Slider(1.6, range=-20..20), ZComponent=0)  # -> Vector, Length
scale = Scale(Geometry=[pline_6, pline_7, pline_8, pline_5], Center=Point(0, 0, 0), Factor=Slider(0.1, range=0..1))  # -> Geometry, Transform
move_3 = Move(Geometry=scale.Geometry, Motion=vec_4.Vector)  # -> Geometry, Transform
draw_5 = Draw(Curve=move_3.Geometry, Accuracy=-1, Outline=outlineex)  # -> SquidInstr, Curve

vec_5 = VectorXYZ(XComponent=Slider(0.1, range=-10..10), YComponent=0, ZComponent=0)  # -> Vector, Length
filll_3 = FillLinear(Line=Line((2, -1, 0), (20, 25, 0)), Params=range_3, Colors=reverse(gradient_3))  # -> Fill, Points
rec = Rectangle({Plane=PlaneXY(12, 3, 0), Size=Domain2(u=0..9, v=0..9)})
outlineex_2 = OutlineEx(Color=RGB(0, 0, 0), Width=1, LineJoin=0, StartCap=1, EndCap=1, Dash="1,1", DashCap=1)
pline_9 = PolyLine(Vertices=[Point(50, 30, 0), Point(180, 30, 0)], Closed=False)

number_slider_2 = Slider(0, range=0..100)
swatch_2 = ColourSwatch(SwatchColor=RGB(255, 255, 255))
pline_10 = PolyLine(
    Vertices=[Point(75, 95, 0), Point(50, 95, 0), Point(50, 75, 0), Point(75, 75, 0), Point(50, 75, 0), Point(50, 55, 0), Point(75, 55, 0)],
    Closed=False)
pline_11 = PolyLine(
    Vertices=[Point(130, 95, 0), Point(95, 95, 0), Point(95, 75, 0), Point(130, 75, 0), Point(130, 55, 0), Point(95, 55, 0)],
    Closed=False)
pline_12 = PolyLine(Vertices=[Point(150, 95, 0), Point(175, 95, 0), Point(175, 55, 0)], Closed=False)
outlineex_3 = OutlineEx(
    Color=RGB(0, 0, 0),
    Width=Slider(1, range=0..10),
    LineJoin=Slider(1, range=0..100),
    StartCap=number_slider_2,
    EndCap=number_slider_2,
    Dash="1",
    DashCap=1)
vec_6 = VectorXYZ(XComponent=Slider(0.4, range=-20..20), YComponent=Slider(1.6, range=-20..20), ZComponent=0)  # -> Vector, Length
scale_2 = Scale(Geometry=[pline_10, pline_11, pline_12, pline_9], Center=Point(0, 0, 0), Factor=Slider(0.1, range=0..1))  # -> Geometry, Transform
move_4 = Move(Geometry=scale_2.Geometry, Motion=vec_6.Vector)  # -> Geometry, Transform
draw_6 = Draw(Curve=move_4.Geometry, Accuracy=-1, Outline=outlineex_3)  # -> SquidInstr, Curve

draw_7 = Draw(Curve=rec, Accuracy=-1, Outline=outlineex_2, Fill=ColourSwatch(SwatchColor=RGBA(0, 149, 255, 122)))  # -> SquidInstr, Curve

number_slider_3 = Slider(0, range=0..100)
swatch_3 = ColourSwatch(SwatchColor=RGB(255, 255, 255))
pline_13 = PolyLine(
    Vertices=[Point(75, 95, 0), Point(50, 95, 0), Point(50, 75, 0), Point(75, 75, 0), Point(50, 75, 0), Point(50, 55, 0), Point(75, 55, 0)],
    Closed=False)
pline_14 = PolyLine(
    Vertices=[Point(130, 95, 0), Point(95, 95, 0), Point(95, 75, 0), Point(130, 75, 0), Point(130, 55, 0), Point(95, 55, 0)],
    Closed=False)
pline_15 = PolyLine(Vertices=[Point(150, 95, 0), Point(175, 95, 0), Point(175, 55, 0)], Closed=False)
outlineex_4 = OutlineEx(
    Color=RGB(0, 0, 0),
    Width=Slider(1, range=0..10),
    LineJoin=Slider(1, range=0..100),
    StartCap=number_slider_3,
    EndCap=number_slider_3,
    Dash="1",
    DashCap=1)
vec_7 = VectorXYZ(XComponent=Slider(4.1, range=-20..20), YComponent=Slider(-3.3, range=-20..20), ZComponent=0)  # -> Vector, Length
scale_3 = Scale(Geometry=[pline_13, pline_14, pline_15], Center=Point(0, 0, 0), Factor=Slider(0.1, range=0..0.1))  # -> Geometry, Transform
move_5 = Move(Geometry=scale_3.Geometry, Motion=vec_7.Vector)  # -> Geometry, Transform
draw_8 = Draw(Curve=move_5.Geometry, Accuracy=-1, Outline=outlineex_4)  # -> SquidInstr, Curve

number_slider_4 = Slider(0, range=0..100)
swatch_4 = ColourSwatch(SwatchColor=RGB(255, 255, 255))
pline_16 = PolyLine(
    Vertices=[Point(75, 95, 0), Point(50, 95, 0), Point(50, 75, 0), Point(75, 75, 0), Point(50, 75, 0), Point(50, 55, 0), Point(75, 55, 0)],
    Closed=False)
pline_17 = PolyLine(
    Vertices=[Point(130, 95, 0), Point(95, 95, 0), Point(95, 75, 0), Point(130, 75, 0), Point(130, 55, 0), Point(95, 55, 0)],
    Closed=False)
pline_18 = PolyLine(Vertices=[Point(150, 95, 0), Point(175, 95, 0), Point(175, 55, 0)], Closed=False)
outlineex_5 = OutlineEx(
    Color=RGB(0, 0, 0),
    Width=Slider(1, range=0..10),
    LineJoin=Slider(1, range=0..100),
    StartCap=number_slider_4,
    EndCap=number_slider_4,
    Dash="1",
    DashCap=1)
vec_8 = VectorXYZ(XComponent=Slider(4.1, range=-20..20), YComponent=Slider(-3.3, range=-20..20), ZComponent=0)  # -> Vector, Length
scale_4 = Scale(Geometry=[pline_16, pline_17, pline_18], Center=Point(0, 0, 0), Factor=Slider(0.1, range=0..0.1))  # -> Geometry, Transform
move_6 = Move(Geometry=scale_4.Geometry, Motion=vec_8.Vector)  # -> Geometry, Transform
draw_9 = Draw(Curve=move_6.Geometry, Accuracy=-1, Outline=outlineex_5)  # -> SquidInstr, Curve

number_slider_5 = Slider(0, range=0..100)
swatch_5 = ColourSwatch(SwatchColor=RGB(255, 255, 255))
pline_19 = PolyLine(
    Vertices=[Point(75, 95, 0), Point(50, 95, 0), Point(50, 75, 0), Point(75, 75, 0), Point(50, 75, 0), Point(50, 55, 0), Point(75, 55, 0)],
    Closed=False)
pline_20 = PolyLine(
    Vertices=[Point(130, 95, 0), Point(95, 95, 0), Point(95, 75, 0), Point(130, 75, 0), Point(130, 55, 0), Point(95, 55, 0)],
    Closed=False)
pline_21 = PolyLine(Vertices=[Point(150, 95, 0), Point(175, 95, 0), Point(175, 55, 0)], Closed=False)
outlineex_6 = OutlineEx(
    Color=RGB(0, 0, 0),
    Width=Slider(1, range=0..10),
    LineJoin=Slider(1, range=0..100),
    StartCap=number_slider_5,
    EndCap=number_slider_5,
    Dash="1",
    DashCap=1)
vec_9 = VectorXYZ(XComponent=Slider(4.1, range=-20..20), YComponent=Slider(-3.3, range=-20..20), ZComponent=0)  # -> Vector, Length
scale_5 = Scale(Geometry=[pline_19, pline_20, pline_21], Center=Point(0, 0, 0), Factor=Slider(0.1, range=0..0.1))  # -> Geometry, Transform
move_7 = Move(Geometry=scale_5.Geometry, Motion=vec_9.Vector)  # -> Geometry, Transform
draw_10 = Draw(Curve=move_7.Geometry, Accuracy=-1, Outline=outlineex_6)  # -> SquidInstr, Curve

number_slider_6 = Slider(0, range=0..100)
swatch_6 = ColourSwatch(SwatchColor=RGB(255, 255, 255))
pline_22 = PolyLine(
    Vertices=[Point(75, 95, 0), Point(50, 95, 0), Point(50, 75, 0), Point(75, 75, 0), Point(50, 75, 0), Point(50, 55, 0), Point(75, 55, 0)],
    Closed=False)
pline_23 = PolyLine(
    Vertices=[Point(130, 95, 0), Point(95, 95, 0), Point(95, 75, 0), Point(130, 75, 0), Point(130, 55, 0), Point(95, 55, 0)],
    Closed=False)
pline_24 = PolyLine(Vertices=[Point(150, 95, 0), Point(175, 95, 0), Point(175, 55, 0)], Closed=False)
outlineex_7 = OutlineEx(
    Color=RGB(0, 0, 0),
    Width=Slider(1, range=0..10),
    LineJoin=Slider(1, range=0..100),
    StartCap=number_slider_6,
    EndCap=number_slider_6,
    Dash="1",
    DashCap=1)
vec_10 = VectorXYZ(XComponent=Slider(4.1, range=-20..20), YComponent=Slider(-3.3, range=-20..20), ZComponent=0)  # -> Vector, Length
scale_6 = Scale(Geometry=[pline_22, pline_23, pline_24], Center=Point(0, 0, 0), Factor=Slider(0.1, range=0..0.1))  # -> Geometry, Transform
move_8 = Move(Geometry=scale_6.Geometry, Motion=vec_10.Vector)  # -> Geometry, Transform
draw_11 = Draw(Curve=move_8.Geometry, Accuracy=-1, Outline=outlineex_7)  # -> SquidInstr, Curve

number_slider_7 = Slider(0, range=0..100)
swatch_7 = ColourSwatch(SwatchColor=RGB(255, 255, 255))
pline_25 = PolyLine(
    Vertices=[Point(75, 95, 0), Point(50, 95, 0), Point(50, 75, 0), Point(75, 75, 0), Point(50, 75, 0), Point(50, 55, 0), Point(75, 55, 0)],
    Closed=False)
pline_26 = PolyLine(
    Vertices=[Point(130, 95, 0), Point(95, 95, 0), Point(95, 75, 0), Point(130, 75, 0), Point(130, 55, 0), Point(95, 55, 0)],
    Closed=False)
pline_27 = PolyLine(Vertices=[Point(150, 95, 0), Point(175, 95, 0), Point(175, 55, 0)], Closed=False)
outlineex_8 = OutlineEx(
    Color=RGB(0, 0, 0),
    Width=Slider(1, range=0..10),
    LineJoin=Slider(1, range=0..100),
    StartCap=number_slider_7,
    EndCap=number_slider_7,
    Dash="1",
    DashCap=1)
vec_11 = VectorXYZ(XComponent=Slider(4.1, range=-20..20), YComponent=Slider(-3.3, range=-20..20), ZComponent=0)  # -> Vector, Length
scale_7 = Scale(Geometry=[pline_25, pline_26, pline_27], Center=Point(0, 0, 0), Factor=Slider(0.1, range=0..0.1))  # -> Geometry, Transform
move_9 = Move(Geometry=scale_7.Geometry, Motion=vec_11.Vector)  # -> Geometry, Transform
draw_12 = Draw(Curve=move_9.Geometry, Accuracy=-1, Outline=outlineex_8)  # -> SquidInstr, Curve

rec_2 = Rectangle({Plane=PlaneXY(0, 0, 0), Size=Domain2(u=0..240, v=0..240)})
pt = PointXYZ(XComponent=Slider(0, range=-10..10), YComponent=Slider(0, range=-10..10), ZComponent=0, System=PlaneXY(0, 0, 0))
move_10 = Move(Geometry=rec_2, Motion=pt)  # -> Geometry, Transform
rec_3 = Rectangle(move_10.Geometry)
outline_3 = Outline(Color=RGB(0, 0, 0), Width=Slider(10, range=0..10))
vec_12 = VectorXYZ(XComponent=Slider(24, range=-100..100), YComponent=Slider(-24, range=-100..100), ZComponent=0)  # -> Vector, Length
clear = Clear(Color=ColourSwatch(SwatchColor=RGBA(255, 255, 255, 0)))
R = Bounds({Plane=PlaneXY(6, 6, 0), Size=Domain2(u=0..12, v=0..12)})

outline_4 = Outline(Color=ColourSwatch(SwatchColor=RGB(143, 143, 143)), Width=Slider(10, range=0..10))
move_11 = Move(Geometry=R, Motion=vec.Vector)  # -> Geometry, Transform

circle = Circle([{Plane=Plane(origin=(61, 119, 0), x=(0.4594229189, -0.8882176432, 0), y=(0.8882176432, 0.4594229189, 0)), Radius=32.64965543}, {Plane=Plane(origin=(119, 110, 0), x=(0.5754934062, -0.8178064193, 0), y=(0.8178064193, 0.5754934062, 0)), Radius=33.01514804}, {Plane=Plane(origin=(163, 113, 0), x=(0.3987261114, -0.9170700563, 0), y=(0.9170700563, 0.3987261114, 0)), Radius=25.07987241}, {Plane=Plane(origin=(141, 154, 0), x=(0.3896399908, -0.9209672511, 0), y=(0.9209672511, 0.3896399908, 0)), Radius=28.23118843}, {Plane=Plane(origin=(90, 142, 0), x=(0.7384854939, -0.674269364, 0), y=(0.674269364, 0.7384854939, 0)), Radius=31.144823}])
vec_13 = VectorXYZ(XComponent=Slider(-16, range=-100..100), YComponent=Slider(-23, range=-100..100), ZComponent=0)  # -> Vector, Length
move_12 = Move(Geometry=circle, Motion=vec_13.Vector)  # -> Geometry, Transform

scale_8 = Scale(Geometry=move_12.Geometry, Center=Point(0, 0, 0), Factor=Slider(1.182, range=0..10))  # -> Geometry, Transform
runion = RegionUnion(Curves=scale_8.Geometry)
draw_13 = Draw(Curve=runion, Accuracy=-1, Outline=outline_3)  # -> SquidInstr, Curve
move_13 = Move(Geometry=runion, Motion=vec_12.Vector)  # -> Geometry, Transform
draw_14 = Draw(Curve=move_13.Geometry, Accuracy=-1, Outline=outline_4)  # -> SquidInstr, Curve

drawex = DrawEx(
    Curves=scale_8.Geometry,
    Accuracy=Slider(10, range=0..10),
    Fill=ColourSwatch(SwatchColor=RGBA(255, 255, 255, 0)),
    Mode=True)  # -> SquidInstr, Curve

merge = Merge(
    Data1=flatten(clear),
    Data2=flatten(draw_14.SquidInstr),
    Data4=flatten(drawex.SquidInstr),
    Data5=flatten(draw_13.SquidInstr))
squid = Squid(BitmapR=rec_3, SquidInstr=merge, PPU=1, AA=True, autohide=False)
image = Image(Bitmap=squid, Bounds=move_11.Geometry, Interpolate=Slider(3, range=0..10))

number_slider_8 = Slider(0.1, range=0..0.1)
swatch_8 = ColourSwatch(SwatchColor=RGB(255, 255, 255))
rec_4 = Rectangle({Plane=PlaneXY(50, 10, 0), Size=Domain2(u=0..145, v=0..208)})
rec_5 = Rectangle({Plane=PlaneXY(40, 30, 0), Size=Domain2(u=0..140, v=0..200)})
scale_9 = Scale(Geometry=rec_4, Center=Point(0, 0, 0), Factor=number_slider_8)  # -> Geometry, Transform
scale_10 = Scale(Geometry=rec_5, Center=Point(0, 0, 0), Factor=number_slider_8)  # -> Geometry, Transform
outlineex_9 = OutlineEx(Color=ColourSwatch(SwatchColor=RGB(0, 0, 0)), Width=1, LineJoin=0, StartCap=1, EndCap=1, Dash="10", DashCap=1)
draw_15 = Draw(Curve=scale_9.Geometry, Accuracy=-1, Fill=ColourSwatch(SwatchColor=RGBA(0, 0, 0, 55)))  # -> SquidInstr, Curve
draw_16 = Draw(Curve=scale_10.Geometry, Accuracy=-1, Outline=outlineex_9, Fill=filll.Fill)  # -> SquidInstr, Curve
merge_2 = Merge(Data2=flatten(draw_15.SquidInstr), Data3=flatten(draw_16.SquidInstr))
R_2 = Bounds({Plane=PlaneXY(0, 0, 0), Size=Domain2(u=0..24, v=0..24)})
merge_3 = Merge(Data2=flatten(merge_2), Data3=flatten(image))
squid_2 = Squid(BitmapR=R_2, SquidInstr=merge_3, PPU=1, AA=False, autohide=False)

rec_6 = Rectangle({Plane=PlaneXY(0, 0, 0), Size=Domain2(u=0..240, v=0..240)})
pt_2 = PointXYZ(XComponent=Slider(0, range=-10..10), YComponent=Slider(0, range=-10..10), ZComponent=0, System=PlaneXY(0, 0, 0))
move_14 = Move(Geometry=rec_6, Motion=pt_2)  # -> Geometry, Transform
rec_7 = Rectangle(move_14.Geometry)
outline_5 = Outline(Color=RGB(0, 0, 0), Width=Slider(10, range=0..10))
vec_14 = VectorXYZ(XComponent=Slider(24, range=-100..100), YComponent=Slider(-24, range=-100..100), ZComponent=0)  # -> Vector, Length
clear_2 = Clear(Color=ColourSwatch(SwatchColor=RGBA(255, 255, 255, 0)))
R_3 = Bounds({Plane=PlaneXY(5, 5, 0), Size=Domain2(u=0..14, v=0..14)})

outline_6 = Outline(Color=ColourSwatch(SwatchColor=RGB(143, 143, 143)), Width=Slider(10, range=0..10))
move_15 = Move(Geometry=R_3, Motion=vec_5.Vector)  # -> Geometry, Transform

rec_8 = Rectangle({Plane=PlaneXY(0, 0, 0), Size=Domain2(u=0..240, v=0..240)})
pt_3 = PointXYZ(XComponent=Slider(0, range=-10..10), YComponent=Slider(0, range=-10..10), ZComponent=0, System=PlaneXY(0, 0, 0))
move_16 = Move(Geometry=rec_8, Motion=pt_3)  # -> Geometry, Transform
rec_9 = Rectangle(move_16.Geometry)
sqgrid = Square(Plane=PlaneXY(10, 110, 0), Size=Slider(12, range=0..100), ExtentX=Slider(8, range=0..10), ExtentY=Slider(2, range=0..10))  # -> flatten(Cells), Points
scale_11 = Scale(Geometry=sqgrid.Cells, Center=Point(0, 0, 0), Factor=Slider(0.1, range=0..0.1))  # -> Geometry, Transform
explode = Explode(Curve=scale_11.Geometry, Recursive=True)  # -> Segments, Vertices
hull = ConvexHull(Points=flatten(explode.Vertices), Plane=PlaneXY(0, 0, 0))  # -> Hull, HullZ, Indices
outline_7 = Outline(Color=RGB(0, 0, 0), Width=Slider(10, range=0..10))
outlineex_10 = OutlineEx(
    Color=ColourSwatch(SwatchColor=RGB(120, 120, 120)),
    Width=Slider(2, range=0..10),
    LineJoin=1,
    StartCap=1,
    EndCap=1,
    Dash="1",
    DashCap=1)
scale_nu = ScaleNU(Geometry=hull.Hull, Plane=PlaneXY(1, 11, 0), ScaleX=Slider(0.894, range=0..1), ScaleY=1, ScaleZ=1)  # -> Geometry, Transform
draw_17 = Draw(Curve=scale_nu.Geometry, Accuracy=-1, Outline=outlineex_10)  # -> SquidInstr, Curve
vec_15 = VectorXYZ(XComponent=Slider(24, range=-100..100), YComponent=Slider(-24, range=-100..100), ZComponent=0)  # -> Vector, Length
clear_3 = Clear(Color=ColourSwatch(SwatchColor=RGBA(255, 255, 255, 0)))
R_4 = Bounds({Plane=PlaneXY(0, 0, 0), Size=Domain2(u=0..24, v=0..24)})

lng = ListLength(List=scale_11.Geometry)
random = Random(Range=Domain(0, 1), Number=lng, Seed=2)
hsl = ColourHSL(Alpha=1, Hue=random, Saturation=1, Luminance=0.5)

rec_10 = Rectangle({Plane=PlaneXY(0, 0, 0), Size=Domain2(u=0..240, v=0..240)})
pt_4 = PointXYZ(XComponent=Slider(0, range=-10..10), YComponent=Slider(0, range=-10..10), ZComponent=0, System=PlaneXY(0, 0, 0))
move_17 = Move(Geometry=rec_10, Motion=pt_4)  # -> Geometry, Transform
rec_11 = Rectangle(move_17.Geometry)
sqgrid_2 = Square(Plane=PlaneXY(10, 110, 0), Size=Slider(12, range=0..100), ExtentX=Slider(8, range=0..10), ExtentY=Slider(2, range=0..10))  # -> flatten(Cells), Points
scale_12 = Scale(Geometry=sqgrid_2.Cells, Center=Point(0, 0, 0), Factor=Slider(0.1, range=0..0.1))  # -> Geometry, Transform
explode_2 = Explode(Curve=scale_12.Geometry, Recursive=True)  # -> Segments, Vertices
hull_2 = ConvexHull(Points=flatten(explode_2.Vertices), Plane=PlaneXY(0, 0, 0))  # -> Hull, HullZ, Indices
outline_8 = Outline(Color=RGB(0, 0, 0), Width=Slider(10, range=0..10))
outlineex_11 = OutlineEx(
    Color=ColourSwatch(SwatchColor=RGB(120, 120, 120)),
    Width=Slider(2, range=0..10),
    LineJoin=1,
    StartCap=1,
    EndCap=1,
    Dash="1",
    DashCap=1)
scale_nu_2 = ScaleNU(Geometry=hull_2.Hull, Plane=PlaneXY(1, 11, 0), ScaleX=Slider(0.894, range=0..1), ScaleY=1, ScaleZ=1)  # -> Geometry, Transform
draw_18 = Draw(Curve=scale_nu_2.Geometry, Accuracy=-1, Outline=outlineex_11)  # -> SquidInstr, Curve
vec_16 = VectorXYZ(XComponent=Slider(24, range=-100..100), YComponent=Slider(-24, range=-100..100), ZComponent=0)  # -> Vector, Length
clear_4 = Clear(Color=ColourSwatch(SwatchColor=RGBA(255, 255, 255, 0)))
R_5 = Bounds({Plane=PlaneXY(0, 0, 0), Size=Domain2(u=0..24, v=0..24)})

lng_2 = ListLength(List=scale_12.Geometry)
random_2 = Random(Range=Domain(0, 1), Number=lng_2, Seed=2)
hsl_2 = ColourHSL(Alpha=1, Hue=random_2, Saturation=1, Luminance=0.5)

rec_12 = Rectangle({Plane=PlaneXY(0, 0, 0), Size=Domain2(u=0..240, v=0..240)})
pt_5 = PointXYZ(XComponent=Slider(0, range=-10..10), YComponent=Slider(0, range=-10..10), ZComponent=0, System=PlaneXY(0, 0, 0))
move_18 = Move(Geometry=rec_12, Motion=pt_5)  # -> Geometry, Transform
rec_13 = Rectangle(move_18.Geometry)
sqgrid_3 = Square(Plane=PlaneXY(10, 110, 0), Size=Slider(12, range=0..100), ExtentX=Slider(8, range=0..10), ExtentY=Slider(2, range=0..10))  # -> flatten(Cells), Points
lng_3 = ListLength(List=sqgrid_3.Cells)
random_3 = Random(Range=Domain(0, 1), Number=lng_3, Seed=2)
smaller = SmallerThan(FirstNumber=Slider(0.25, range=0..1), SecondNumber=random_3)  # -> SmallerThan, OrEqualTo
scale_13 = Scale(Geometry=sqgrid_3.Cells, Center=Point(0, 0, 0), Factor=Slider(0.1, range=0..0.1))  # -> Geometry, Transform
explode_3 = Explode(Curve=scale_13.Geometry, Recursive=True)  # -> Segments, Vertices
dispatch = Dispatch(List=scale_13.Geometry, DispatchPattern=smaller.SmallerThan)  # -> ListA, ListB
hull_3 = ConvexHull(Points=flatten(explode_3.Vertices), Plane=PlaneXY(0, 0, 0))  # -> Hull, HullZ, Indices
outline_9 = Outline(Color=RGB(0, 0, 0), Width=Slider(10, range=0..10))
outlineex_12 = OutlineEx(
    Color=ColourSwatch(SwatchColor=RGB(120, 120, 120)),
    Width=Slider(2, range=0..10),
    LineJoin=1,
    StartCap=1,
    EndCap=1,
    Dash="1",
    DashCap=1)
draw_19 = Draw(Curve=dispatch.ListB, Accuracy=-1, Fill=ColourSwatch(SwatchColor=RGB(0, 0, 0)))  # -> SquidInstr, Curve
draw_20 = Draw(Curve=dispatch.ListA, Accuracy=-1, Fill=ColourSwatch(SwatchColor=RGB(255, 255, 255)))  # -> SquidInstr, Curve
scale_nu_3 = ScaleNU(Geometry=hull_3.Hull, Plane=PlaneXY(1, 11, 0), ScaleX=Slider(0.894, range=0..1), ScaleY=1, ScaleZ=1)  # -> Geometry, Transform
draw_21 = Draw(Curve=scale_nu_3.Geometry, Accuracy=-1, Outline=outlineex_12)  # -> SquidInstr, Curve
vec_17 = VectorXYZ(XComponent=Slider(24, range=-100..100), YComponent=Slider(-24, range=-100..100), ZComponent=0)  # -> Vector, Length
clear_5 = Clear(Color=ColourSwatch(SwatchColor=RGBA(255, 255, 255, 0)))
R_6 = Bounds({Plane=PlaneXY(0, 0, 0), Size=Domain2(u=0..24, v=0..24)})

rec_14 = Rectangle({Plane=PlaneXY(0, 0, 0), Size=Domain2(u=0..240, v=0..240)})
pt_6 = PointXYZ(XComponent=Slider(0, range=-10..10), YComponent=Slider(0, range=-10..10), ZComponent=0, System=PlaneXY(0, 0, 0))
move_19 = Move(Geometry=rec_14, Motion=pt_6)  # -> Geometry, Transform
rec_15 = Rectangle(move_19.Geometry)
outline_10 = Outline(Color=RGB(0, 0, 0), Width=Slider(10, range=0..10))
vec_18 = VectorXYZ(XComponent=Slider(24, range=-100..100), YComponent=Slider(-24, range=-100..100), ZComponent=0)  # -> Vector, Length
clear_6 = Clear(Color=ColourSwatch(SwatchColor=RGBA(255, 255, 255, 0)))
R_7 = Bounds({Plane=PlaneXY(0, 0, 0), Size=Domain2(u=0..24, v=0..24)})

outline_11 = Outline(Color=ColourSwatch(SwatchColor=RGB(143, 143, 143)), Width=Slider(10, range=0..10))

rec_16 = Rectangle({Plane=PlaneXY(0, 0, 0), Size=Domain2(u=0..240, v=0..240)})
pt_7 = PointXYZ(XComponent=Slider(0, range=-10..10), YComponent=Slider(0, range=-10..10), ZComponent=0, System=PlaneXY(0, 0, 0))
move_20 = Move(Geometry=rec_16, Motion=pt_7)  # -> Geometry, Transform
rec_17 = Rectangle(move_20.Geometry)
sqgrid_4 = Square(Plane=PlaneXY(10, 110, 0), Size=Slider(12, range=0..100), ExtentX=Slider(8, range=0..10), ExtentY=Slider(2, range=0..10))  # -> flatten(Cells), Points
lng_4 = ListLength(List=sqgrid_4.Cells)
random_4 = Random(Range=Domain(0, 1), Number=lng_4, Seed=2)
smaller_2 = SmallerThan(FirstNumber=Slider(0.25, range=0..1), SecondNumber=random_4)  # -> SmallerThan, OrEqualTo
scale_14 = Scale(Geometry=sqgrid_4.Cells, Center=Point(0, 0, 0), Factor=Slider(0.1, range=0..0.1))  # -> Geometry, Transform
explode_4 = Explode(Curve=scale_14.Geometry, Recursive=True)  # -> Segments, Vertices
dispatch_2 = Dispatch(List=scale_14.Geometry, DispatchPattern=smaller_2.SmallerThan)  # -> ListA, ListB
hull_4 = ConvexHull(Points=flatten(explode_4.Vertices), Plane=PlaneXY(0, 0, 0))  # -> Hull, HullZ, Indices
outline_12 = Outline(Color=RGB(0, 0, 0), Width=Slider(10, range=0..10))
swatch_9 = ColourSwatch(SwatchColor=RGB(255, 255, 255))
outlineex_13 = OutlineEx(
    Color=ColourSwatch(SwatchColor=RGB(0, 0, 0)),
    Width=Slider(2, range=0..10),
    LineJoin=1,
    StartCap=1,
    EndCap=1,
    Dash="1",
    DashCap=1)
draw_22 = Draw(Curve=dispatch_2.ListB, Accuracy=-1, Fill=ColourSwatch(SwatchColor=RGB(0, 0, 0)))  # -> SquidInstr, Curve
draw_23 = Draw(Curve=dispatch_2.ListA, Accuracy=-1, Fill=ColourSwatch(SwatchColor=RGB(255, 255, 255)))  # -> SquidInstr, Curve
scale_nu_4 = ScaleNU(Geometry=hull_4.Hull, Plane=PlaneXY(1, 11, 0), ScaleX=Slider(0.894, range=0..1), ScaleY=1, ScaleZ=1)  # -> Geometry, Transform
draw_24 = Draw(Curve=scale_nu_4.Geometry, Accuracy=-1, Outline=outlineex_13)  # -> SquidInstr, Curve
vec_19 = VectorXYZ(XComponent=Slider(24, range=-100..100), YComponent=Slider(-24, range=-100..100), ZComponent=0)  # -> Vector, Length
clear_7 = Clear(Color=ColourSwatch(SwatchColor=RGBA(255, 255, 255, 0)))
R_8 = Bounds({Plane=PlaneXY(0, 0, 0), Size=Domain2(u=0..24, v=0..24)})

rec_18 = Rectangle({Plane=PlaneXY(0, 0, 0), Size=Domain2(u=0..240, v=0..240)})
pt_8 = PointXYZ(XComponent=Slider(0, range=-10..10), YComponent=Slider(0, range=-10..10), ZComponent=0, System=PlaneXY(0, 0, 0))
move_21 = Move(Geometry=rec_18, Motion=pt_8)  # -> Geometry, Transform
rec_19 = Rectangle(move_21.Geometry)
outline_13 = Outline(Color=RGB(0, 0, 0), Width=Slider(10, range=0..10))
vec_20 = VectorXYZ(XComponent=Slider(24, range=-100..100), YComponent=Slider(-24, range=-100..100), ZComponent=0)  # -> Vector, Length
clear_8 = Clear(Color=ColourSwatch(SwatchColor=RGBA(255, 255, 255, 0)))
R_9 = Bounds({Plane=PlaneXY(0, 0, 0), Size=Domain2(u=0..24, v=0..24)})

circle_2 = Circle([{Plane=Plane(origin=(61, 119, 0), x=(0.4594229189, -0.8882176432, 0), y=(0.8882176432, 0.4594229189, 0)), Radius=32.64965543}, {Plane=Plane(origin=(119, 110, 0), x=(0.5754934062, -0.8178064193, 0), y=(0.8178064193, 0.5754934062, 0)), Radius=33.01514804}, {Plane=Plane(origin=(163, 113, 0), x=(0.3987261114, -0.9170700563, 0), y=(0.9170700563, 0.3987261114, 0)), Radius=25.07987241}, {Plane=Plane(origin=(141, 154, 0), x=(0.3896399908, -0.9209672511, 0), y=(0.9209672511, 0.3896399908, 0)), Radius=28.23118843}, {Plane=Plane(origin=(90, 142, 0), x=(0.7384854939, -0.674269364, 0), y=(0.674269364, 0.7384854939, 0)), Radius=31.144823}])
vec_21 = VectorXYZ(XComponent=Slider(-16, range=-100..100), YComponent=Slider(-23, range=-100..100), ZComponent=0)  # -> Vector, Length
move_22 = Move(Geometry=circle_2, Motion=vec_21.Vector)  # -> Geometry, Transform

rec_20 = Rectangle({Plane=PlaneXY(0, 0, 0), Size=Domain2(u=0..240, v=0..240)})
pt_9 = PointXYZ(XComponent=Slider(0, range=-10..10), YComponent=Slider(0, range=-10..10), ZComponent=0, System=PlaneXY(0, 0, 0))
move_23 = Move(Geometry=rec_20, Motion=pt_9)  # -> Geometry, Transform
rec_21 = Rectangle(move_23.Geometry)
outline_14 = Outline(Color=RGB(0, 0, 0), Width=Slider(10, range=0..10))
vec_22 = VectorXYZ(XComponent=Slider(24, range=-100..100), YComponent=Slider(-24, range=-100..100), ZComponent=0)  # -> Vector, Length
clear_9 = Clear(Color=ColourSwatch(SwatchColor=RGBA(255, 255, 255, 0)))
R_10 = Bounds({Plane=PlaneXY(0, 0, 0), Size=Domain2(u=0..24, v=0..24)})

rec_22 = Rectangle({Plane=PlaneXY(0, 0, 0), Size=Domain2(u=0..240, v=0..240)})
pt_10 = PointXYZ(XComponent=Slider(0, range=-10..10), YComponent=Slider(0, range=-10..10), ZComponent=0, System=PlaneXY(0, 0, 0))
move_24 = Move(Geometry=rec_22, Motion=pt_10)  # -> Geometry, Transform
rec_23 = Rectangle(move_24.Geometry)
outline_15 = Outline(Color=RGB(0, 0, 0), Width=Slider(10, range=0..10))
vec_23 = VectorXYZ(XComponent=Slider(24, range=-100..100), YComponent=Slider(-24, range=-100..100), ZComponent=0)  # -> Vector, Length
clear_10 = Clear(Color=ColourSwatch(SwatchColor=RGBA(255, 255, 255, 0)))
R_11 = Bounds({Plane=PlaneXY(0, 0, 0), Size=Domain2(u=0..24, v=0..24)})

circle_3 = Circle([{Plane=Plane(origin=(61, 119, 0), x=(0.4594229189, -0.8882176432, 0), y=(0.8882176432, 0.4594229189, 0)), Radius=32.64965543}, {Plane=Plane(origin=(119, 110, 0), x=(0.5754934062, -0.8178064193, 0), y=(0.8178064193, 0.5754934062, 0)), Radius=33.01514804}, {Plane=Plane(origin=(163, 113, 0), x=(0.3987261114, -0.9170700563, 0), y=(0.9170700563, 0.3987261114, 0)), Radius=25.07987241}, {Plane=Plane(origin=(141, 154, 0), x=(0.3896399908, -0.9209672511, 0), y=(0.9209672511, 0.3896399908, 0)), Radius=28.23118843}, {Plane=Plane(origin=(90, 142, 0), x=(0.7384854939, -0.674269364, 0), y=(0.674269364, 0.7384854939, 0)), Radius=31.144823}])
vec_24 = VectorXYZ(XComponent=Slider(-12, range=-100..100), YComponent=Slider(-24, range=-100..100), ZComponent=0)  # -> Vector, Length
move_25 = Move(Geometry=circle_3, Motion=vec_24.Vector)  # -> Geometry, Transform

circle_4 = Circle([{Plane=Plane(origin=(61, 119, 0), x=(0.4594229189, -0.8882176432, 0), y=(0.8882176432, 0.4594229189, 0)), Radius=32.64965543}, {Plane=Plane(origin=(119, 110, 0), x=(0.5754934062, -0.8178064193, 0), y=(0.8178064193, 0.5754934062, 0)), Radius=33.01514804}, {Plane=Plane(origin=(163, 113, 0), x=(0.3987261114, -0.9170700563, 0), y=(0.9170700563, 0.3987261114, 0)), Radius=25.07987241}, {Plane=Plane(origin=(141, 154, 0), x=(0.3896399908, -0.9209672511, 0), y=(0.9209672511, 0.3896399908, 0)), Radius=28.23118843}, {Plane=Plane(origin=(90, 142, 0), x=(0.7384854939, -0.674269364, 0), y=(0.674269364, 0.7384854939, 0)), Radius=31.144823}])
vec_25 = VectorXYZ(XComponent=Slider(-12, range=-100..100), YComponent=Slider(-24, range=-100..100), ZComponent=0)  # -> Vector, Length
move_26 = Move(Geometry=circle_4, Motion=vec_25.Vector)  # -> Geometry, Transform

scale_15 = Scale(Geometry=move_22.Geometry, Center=Point(0, 0, 0), Factor=Slider(1.182, range=0..10))  # -> Geometry, Transform
runion_2 = RegionUnion(Curves=scale_15.Geometry)
draw_25 = Draw(Curve=runion_2, Accuracy=-1, Outline=outline_5)  # -> SquidInstr, Curve
move_27 = Move(Geometry=runion_2, Motion=vec_14.Vector)  # -> Geometry, Transform
draw_26 = Draw(Curve=move_27.Geometry, Accuracy=-1, Outline=outline_6)  # -> SquidInstr, Curve

drawex_2 = DrawEx(
    Curves=scale_15.Geometry,
    Accuracy=Slider(10, range=0..10),
    Fill=ColourSwatch(SwatchColor=RGBA(255, 255, 255, 0)),
    Mode=True)  # -> SquidInstr, Curve

merge_4 = Merge(
    Data1=flatten(clear_2),
    Data2=flatten(draw_26.SquidInstr),
    Data4=flatten(drawex_2.SquidInstr),
    Data5=flatten(draw_25.SquidInstr))
squid_3 = Squid(BitmapR=rec_7, SquidInstr=merge_4, PPU=1, AA=True, autohide=False)
image_2 = Image(Bitmap=squid_3, Bounds=move_15.Geometry, Interpolate=Slider(3, range=0..10))

circle_5 = Circle([{Plane=Plane(origin=(61, 119, 0), x=(0.4594229189, -0.8882176432, 0), y=(0.8882176432, 0.4594229189, 0)), Radius=32.64965543}, {Plane=Plane(origin=(119, 110, 0), x=(0.5754934062, -0.8178064193, 0), y=(0.8178064193, 0.5754934062, 0)), Radius=33.01514804}, {Plane=Plane(origin=(163, 113, 0), x=(0.3987261114, -0.9170700563, 0), y=(0.9170700563, 0.3987261114, 0)), Radius=25.07987241}, {Plane=Plane(origin=(141, 154, 0), x=(0.3896399908, -0.9209672511, 0), y=(0.9209672511, 0.3896399908, 0)), Radius=28.23118843}, {Plane=Plane(origin=(90, 142, 0), x=(0.7384854939, -0.674269364, 0), y=(0.674269364, 0.7384854939, 0)), Radius=31.144823}])
vec_26 = VectorXYZ(XComponent=Slider(-12, range=-100..100), YComponent=Slider(-24, range=-100..100), ZComponent=0)  # -> Vector, Length
move_28 = Move(Geometry=circle_5, Motion=vec_26.Vector)  # -> Geometry, Transform

circle_6 = Circle([{Plane=Plane(origin=(61, 119, 0), x=(0.4594229189, -0.8882176432, 0), y=(0.8882176432, 0.4594229189, 0)), Radius=32.64965543}, {Plane=Plane(origin=(119, 110, 0), x=(0.5754934062, -0.8178064193, 0), y=(0.8178064193, 0.5754934062, 0)), Radius=33.01514804}, {Plane=Plane(origin=(163, 113, 0), x=(0.3987261114, -0.9170700563, 0), y=(0.9170700563, 0.3987261114, 0)), Radius=25.07987241}, {Plane=Plane(origin=(141, 154, 0), x=(0.3896399908, -0.9209672511, 0), y=(0.9209672511, 0.3896399908, 0)), Radius=28.23118843}, {Plane=Plane(origin=(90, 142, 0), x=(0.7384854939, -0.674269364, 0), y=(0.674269364, 0.7384854939, 0)), Radius=31.144823}])
vec_27 = VectorXYZ(XComponent=Slider(-16, range=-100..100), YComponent=Slider(-23, range=-100..100), ZComponent=0)  # -> Vector, Length
move_29 = Move(Geometry=circle_6, Motion=vec_27.Vector)  # -> Geometry, Transform

circle_7 = Circle([{Plane=Plane(origin=(61, 119, 0), x=(0.4594229189, -0.8882176432, 0), y=(0.8882176432, 0.4594229189, 0)), Radius=32.64965543}, {Plane=Plane(origin=(119, 110, 0), x=(0.5754934062, -0.8178064193, 0), y=(0.8178064193, 0.5754934062, 0)), Radius=33.01514804}, {Plane=Plane(origin=(163, 113, 0), x=(0.3987261114, -0.9170700563, 0), y=(0.9170700563, 0.3987261114, 0)), Radius=25.07987241}, {Plane=Plane(origin=(141, 154, 0), x=(0.3896399908, -0.9209672511, 0), y=(0.9209672511, 0.3896399908, 0)), Radius=28.23118843}, {Plane=Plane(origin=(90, 142, 0), x=(0.7384854939, -0.674269364, 0), y=(0.674269364, 0.7384854939, 0)), Radius=31.144823}])
vec_28 = VectorXYZ(XComponent=Slider(-12, range=-100..100), YComponent=Slider(-24, range=-100..100), ZComponent=0)  # -> Vector, Length
move_30 = Move(Geometry=circle_7, Motion=vec_28.Vector)  # -> Geometry, Transform

circle_8 = Circle([{Plane=Plane(origin=(61, 119, 0), x=(0.4594229189, -0.8882176432, 0), y=(0.8882176432, 0.4594229189, 0)), Radius=32.64965543}, {Plane=Plane(origin=(119, 110, 0), x=(0.5754934062, -0.8178064193, 0), y=(0.8178064193, 0.5754934062, 0)), Radius=33.01514804}, {Plane=Plane(origin=(163, 113, 0), x=(0.3987261114, -0.9170700563, 0), y=(0.9170700563, 0.3987261114, 0)), Radius=25.07987241}, {Plane=Plane(origin=(141, 154, 0), x=(0.3896399908, -0.9209672511, 0), y=(0.9209672511, 0.3896399908, 0)), Radius=28.23118843}, {Plane=Plane(origin=(90, 142, 0), x=(0.7384854939, -0.674269364, 0), y=(0.674269364, 0.7384854939, 0)), Radius=31.144823}])
vec_29 = VectorXYZ(XComponent=Slider(-12, range=-100..100), YComponent=Slider(-24, range=-100..100), ZComponent=0)  # -> Vector, Length
move_31 = Move(Geometry=circle_8, Motion=vec_29.Vector)  # -> Geometry, Transform

range_4 = Range(Domain=Domain(0, 1), Steps=Slider(30, range=0..100))
gradient_4 = Gradient(LowerLimit=0, UpperLimit=1, Parameter=range_4, stops=[0.385: RGB(255, 255, 255), 0.576: RGB(184, 0, 0)])
filll_4 = FillLinear(Line=Line((0, 0, 0), (241, 241, 0)), Params=range_4, Colors=gradient_4)  # -> Fill, Points
number_slider_9 = Slider(12, range=0..100)
number_slider_10 = Slider(5, range=0..10)
swatch_10 = ColourSwatch(SwatchColor=RGB(0, 0, 0))
swatch_11 = ColourSwatch(SwatchColor=RGB(110, 4, 8))
geo_5 = Geometry(rec_21)
clear_11 = Clear(Color=swatch_10)
sqgrid_5 = Square(Plane=PlaneXY(0, 0, 0), Size=Slider(40, range=0..100), ExtentX=number_slider_9, ExtentY=number_slider_9)  # -> flatten(Cells), Points
vec_30 = VectorXYZ(XComponent=number_slider_10, YComponent=number_slider_10, ZComponent=0)  # -> Vector, Length
swatch_12 = ColourSwatch(SwatchColor=RGB(110, 4, 8))
move_32 = Move(Geometry=sqgrid_5.Cells, Motion=vec_30.Vector)  # -> Geometry, Transform
outline_16 = Outline(Color=swatch_10, Width=Slider(7, range=0..10))
pmedges = PmUniqueEdges(Polylines=move_32.Geometry)  # -> Edges, Topology
draw_27 = Draw(Curve=pmedges.Edges, Accuracy=-1, Outline=outline_16)  # -> SquidInstr, Curve

circle_9 = Circle([{Plane=Plane(origin=(61, 119, 0), x=(0.4594229189, -0.8882176432, 0), y=(0.8882176432, 0.4594229189, 0)), Radius=32.64965543}, {Plane=Plane(origin=(119, 110, 0), x=(0.5754934062, -0.8178064193, 0), y=(0.8178064193, 0.5754934062, 0)), Radius=33.01514804}, {Plane=Plane(origin=(163, 113, 0), x=(0.3987261114, -0.9170700563, 0), y=(0.9170700563, 0.3987261114, 0)), Radius=25.07987241}, {Plane=Plane(origin=(141, 154, 0), x=(0.3896399908, -0.9209672511, 0), y=(0.9209672511, 0.3896399908, 0)), Radius=28.23118843}, {Plane=Plane(origin=(90, 142, 0), x=(0.7384854939, -0.674269364, 0), y=(0.674269364, 0.7384854939, 0)), Radius=31.144823}])
swatch_13 = ColourSwatch(SwatchColor=RGBA(255, 255, 255, 0))
vec_31 = VectorXYZ(XComponent=Slider(-12, range=-100..100), YComponent=Slider(-24, range=-100..100), ZComponent=0)  # -> Vector, Length
move_33 = Move(Geometry=circle_9, Motion=vec_31.Vector)  # -> Geometry, Transform

scale_16 = Scale(Geometry=move_25.Geometry, Center=Point(0, 0, 0), Factor=Slider(1.182, range=0..10))  # -> Geometry, Transform
runion_3 = RegionUnion(Curves=scale_16.Geometry)
draw_28 = Draw(Curve=scale_11.Geometry, Accuracy=-1, Fill=hsl)  # -> SquidInstr, Curve
draw_29 = Draw(Curve=runion_3, Accuracy=-1, Outline=outline_7, Fill=ColourSwatch(SwatchColor=RGB(255, 255, 255)))  # -> SquidInstr, Curve
move_34 = Move(Geometry=runion_3, Motion=vec_15.Vector)  # -> Geometry, Transform
draw_30 = Draw(Curve=move_34.Geometry, Accuracy=-1, Fill=ColourSwatch(SwatchColor=RGB(143, 143, 143)))  # -> SquidInstr, Curve

drawex_3 = DrawEx(Curves=scale_16.Geometry, Accuracy=Slider(10, range=0..10), Mode=True)  # -> SquidInstr, Curve

merge_5 = Merge(
    Data1=flatten(clear_3),
    Data2=flatten(draw_30.SquidInstr),
    Data3=flatten(drawex_3.SquidInstr),
    Data4=flatten(draw_29.SquidInstr))
squid_4 = Squid(BitmapR=rec_9, SquidInstr=merge_5, PPU=1, AA=True, autohide=False)
image_3 = Image(Bitmap=squid_4, Bounds=R_4, Interpolate=Slider(3, range=0..10))
merge_6 = Merge(Data1=flatten(image_3), Data2=flatten(draw_17.SquidInstr), Data3=flatten(draw_28.SquidInstr))
squid_5 = Squid(BitmapR=R_4, SquidInstr=merge_6, PPU=1, AA=False, autohide=False)

circle_10 = Circle([{Plane=Plane(origin=(61, 119, 0), x=(0.4594229189, -0.8882176432, 0), y=(0.8882176432, 0.4594229189, 0)), Radius=32.64965543}, {Plane=Plane(origin=(119, 110, 0), x=(0.5754934062, -0.8178064193, 0), y=(0.8178064193, 0.5754934062, 0)), Radius=33.01514804}, {Plane=Plane(origin=(163, 113, 0), x=(0.3987261114, -0.9170700563, 0), y=(0.9170700563, 0.3987261114, 0)), Radius=25.07987241}, {Plane=Plane(origin=(141, 154, 0), x=(0.3896399908, -0.9209672511, 0), y=(0.9209672511, 0.3896399908, 0)), Radius=28.23118843}, {Plane=Plane(origin=(90, 142, 0), x=(0.7384854939, -0.674269364, 0), y=(0.674269364, 0.7384854939, 0)), Radius=31.144823}])
vec_32 = VectorXYZ(XComponent=Slider(-16, range=-100..100), YComponent=Slider(-23, range=-100..100), ZComponent=0)  # -> Vector, Length
move_35 = Move(Geometry=circle_10, Motion=vec_32.Vector)  # -> Geometry, Transform

scale_17 = Scale(Geometry=move_26.Geometry, Center=Point(0, 0, 0), Factor=Slider(1.182, range=0..10))  # -> Geometry, Transform
runion_4 = RegionUnion(Curves=scale_17.Geometry)
draw_31 = Draw(Curve=scale_12.Geometry, Accuracy=-1, Fill=hsl_2)  # -> SquidInstr, Curve
draw_32 = Draw(Curve=runion_4, Accuracy=-1, Outline=outline_8, Fill=ColourSwatch(SwatchColor=RGB(255, 255, 255)))  # -> SquidInstr, Curve
move_36 = Move(Geometry=runion_4, Motion=vec_16.Vector)  # -> Geometry, Transform
draw_33 = Draw(Curve=move_36.Geometry, Accuracy=-1, Fill=ColourSwatch(SwatchColor=RGB(143, 143, 143)))  # -> SquidInstr, Curve

drawex_4 = DrawEx(Curves=scale_17.Geometry, Accuracy=Slider(10, range=0..10), Mode=True)  # -> SquidInstr, Curve

merge_7 = Merge(
    Data1=flatten(clear_4),
    Data2=flatten(draw_33.SquidInstr),
    Data3=flatten(drawex_4.SquidInstr),
    Data4=flatten(draw_32.SquidInstr))
squid_6 = Squid(BitmapR=rec_11, SquidInstr=merge_7, PPU=1, AA=True, autohide=False)
image_4 = Image(Bitmap=squid_6, Bounds=R_5, Interpolate=Slider(3, range=0..10))
merge_8 = Merge(Data1=flatten(image_4), Data2=flatten(draw_18.SquidInstr), Data3=flatten(draw_31.SquidInstr))
squid_7 = Squid(BitmapR=R_5, SquidInstr=merge_8, PPU=1, AA=False, autohide=False)

R_12 = Bounds({Plane=PlaneXY(0, 0, 0), Size=Domain2(u=0..24, v=0..24)})
vec_33 = VectorXYZ(XComponent=0, YComponent=Slider(2.513, range=0..10), ZComponent=0)  # -> Vector, Length
move_37 = Move(Geometry=R_12, Motion=vec_33.Vector)  # -> Geometry, Transform
image_5 = Image(Bitmap=squid_7, Bounds=move_37.Geometry, Interpolate=Slider(3, range=0..10))
R_13 = Bounds({Plane=PlaneXY(0, 0, 0), Size=Domain2(u=0..24, v=0..24)})
merge_9 = Merge(Data1=flatten(image_5), Data2=flatten(draw_8.SquidInstr))
squid_8 = Squid(BitmapR=R_13, SquidInstr=merge_9, PPU=1, AA=False, autohide=False)

scale_18 = Scale(Geometry=move_28.Geometry, Center=Point(0, 0, 0), Factor=Slider(1.182, range=0..10))  # -> Geometry, Transform
runion_5 = RegionUnion(Curves=scale_18.Geometry)
draw_34 = Draw(Curve=runion_5, Accuracy=-1, Outline=outline_9, Fill=ColourSwatch(SwatchColor=RGB(255, 255, 255)))  # -> SquidInstr, Curve
move_38 = Move(Geometry=runion_5, Motion=vec_17.Vector)  # -> Geometry, Transform
draw_35 = Draw(Curve=move_38.Geometry, Accuracy=-1, Fill=ColourSwatch(SwatchColor=RGB(143, 143, 143)))  # -> SquidInstr, Curve

drawex_5 = DrawEx(Curves=scale_18.Geometry, Accuracy=Slider(10, range=0..10), Mode=True)  # -> SquidInstr, Curve

merge_10 = Merge(
    Data1=flatten(clear_5),
    Data2=flatten(draw_35.SquidInstr),
    Data3=flatten(drawex_5.SquidInstr),
    Data4=flatten(draw_34.SquidInstr))
squid_9 = Squid(BitmapR=rec_13, SquidInstr=merge_10, PPU=1, AA=True, autohide=False)
image_6 = Image(Bitmap=squid_9, Bounds=R_6, Interpolate=Slider(3, range=0..10))
merge_11 = Merge(
    Data1=flatten(image_6),
    Data2=flatten(draw_21.SquidInstr),
    Data3=flatten(draw_20.SquidInstr),
    Data4=flatten(draw_19.SquidInstr))
squid_10 = Squid(BitmapR=R_6, SquidInstr=merge_11, PPU=1, AA=False, autohide=False)

R_14 = Bounds({Plane=PlaneXY(0, 0, 0), Size=Domain2(u=0..24, v=0..24)})
vec_34 = VectorXYZ(XComponent=0, YComponent=Slider(2.513, range=0..10), ZComponent=0)  # -> Vector, Length
move_39 = Move(Geometry=R_14, Motion=vec_34.Vector)  # -> Geometry, Transform
image_7 = Image(Bitmap=squid_10, Bounds=move_39.Geometry, Interpolate=Slider(3, range=0..10))
R_15 = Bounds({Plane=PlaneXY(0, 0, 0), Size=Domain2(u=0..24, v=0..24)})
merge_12 = Merge(Data1=flatten(image_7), Data2=flatten(draw_9.SquidInstr))
squid_11 = Squid(BitmapR=R_15, SquidInstr=merge_12, PPU=1, AA=False, autohide=False)

scale_19 = Scale(Geometry=move_29.Geometry, Center=Point(0, 0, 0), Factor=Slider(1.182, range=0..10))  # -> Geometry, Transform
runion_6 = RegionUnion(Curves=scale_19.Geometry)
draw_36 = Draw(Curve=runion_6, Accuracy=-1, Outline=outline_10)  # -> SquidInstr, Curve
move_40 = Move(Geometry=runion_6, Motion=vec_18.Vector)  # -> Geometry, Transform
draw_37 = Draw(Curve=move_40.Geometry, Accuracy=-1, Outline=outline_11)  # -> SquidInstr, Curve

drawex_6 = DrawEx(
    Curves=scale_19.Geometry,
    Accuracy=Slider(10, range=0..10),
    Fill=ColourSwatch(SwatchColor=RGBA(255, 255, 255, 0)),
    Mode=True)  # -> SquidInstr, Curve

merge_13 = Merge(
    Data1=flatten(clear_6),
    Data2=flatten(draw_37.SquidInstr),
    Data4=flatten(drawex_6.SquidInstr),
    Data5=flatten(draw_36.SquidInstr))
squid_12 = Squid(BitmapR=rec_15, SquidInstr=merge_13, PPU=1, AA=True, autohide=False)
image_8 = Image(Bitmap=squid_12, Bounds=R_7, Interpolate=Slider(3, range=0..10))
squid_13 = Squid(BitmapR=R_7, SquidInstr=image_8, PPU=1, AA=True, autohide=False)

scale_20 = Scale(Geometry=move_30.Geometry, Center=Point(0, 0, 0), Factor=Slider(1.182, range=0..10))  # -> Geometry, Transform
runion_7 = RegionUnion(Curves=scale_20.Geometry)
draw_38 = Draw(Curve=runion_7, Accuracy=-1, Outline=outline_12, Fill=ColourSwatch(SwatchColor=RGB(133, 133, 133)))  # -> SquidInstr, Curve
move_41 = Move(Geometry=runion_7, Motion=vec_19.Vector)  # -> Geometry, Transform
draw_39 = Draw(Curve=move_41.Geometry, Accuracy=-1, Fill=ColourSwatch(SwatchColor=RGB(143, 143, 143)))  # -> SquidInstr, Curve

drawex_7 = DrawEx(Curves=scale_20.Geometry, Accuracy=Slider(10, range=0..10), Mode=True)  # -> SquidInstr, Curve

merge_14 = Merge(
    Data1=flatten(clear_7),
    Data2=flatten(draw_39.SquidInstr),
    Data3=flatten(drawex_7.SquidInstr),
    Data4=flatten(draw_38.SquidInstr))
squid_14 = Squid(BitmapR=rec_17, SquidInstr=merge_14, PPU=1, AA=True, autohide=False)
image_9 = Image(Bitmap=squid_14, Bounds=R_8, Interpolate=Slider(3, range=0..10))
merge_15 = Merge(
    Data1=flatten(image_9),
    Data2=flatten(draw_24.SquidInstr),
    Data3=flatten(draw_23.SquidInstr),
    Data4=flatten(draw_22.SquidInstr))
squid_15 = Squid(BitmapR=R_8, SquidInstr=merge_15, PPU=1, AA=False, autohide=False)

R_16 = Bounds({Plane=PlaneXY(0, 0, 0), Size=Domain2(u=0..24, v=0..24)})
vec_35 = VectorXYZ(XComponent=0, YComponent=Slider(2.513, range=0..10), ZComponent=0)  # -> Vector, Length
move_42 = Move(Geometry=R_16, Motion=vec_35.Vector)  # -> Geometry, Transform
image_10 = Image(Bitmap=squid_15, Bounds=move_42.Geometry, Interpolate=Slider(3, range=0..10))
R_17 = Bounds({Plane=PlaneXY(0, 0, 0), Size=Domain2(u=0..24, v=0..24)})
merge_16 = Merge(Data1=flatten(image_10), Data2=flatten(draw_10.SquidInstr))
squid_16 = Squid(BitmapR=R_17, SquidInstr=merge_16, PPU=1, AA=False, autohide=False)

scale_21 = Scale(Geometry=move_31.Geometry, Center=Point(0, 0, 0), Factor=Slider(1.182, range=0..10))  # -> Geometry, Transform
runion_8 = RegionUnion(Curves=scale_21.Geometry)
draw_40 = Draw(Curve=runion_8, Accuracy=-1, Outline=outline_13)  # -> SquidInstr, Curve
move_43 = Move(Geometry=runion_8, Motion=vec_20.Vector)  # -> Geometry, Transform
draw_41 = Draw(Curve=move_43.Geometry, Accuracy=-1, Fill=ColourSwatch(SwatchColor=RGB(143, 143, 143)))  # -> SquidInstr, Curve

drawex_8 = DrawEx(Curves=scale_21.Geometry, Accuracy=Slider(10, range=0..10), Fill=ColourSwatch(SwatchColor=RGB(255, 255, 255)), Mode=True)  # -> SquidInstr, Curve

merge_17 = Merge(
    Data1=flatten(clear_8),
    Data2=flatten(draw_41.SquidInstr),
    Data4=flatten(drawex_8.SquidInstr),
    Data5=flatten(draw_40.SquidInstr),
    Data6=flatten(over),
    Data7=flatten(draw.SquidInstr),
    Data8=flatten(draw_3.SquidInstr),
    Data9=flatten(draw_2.SquidInstr))
squid_17 = Squid(BitmapR=rec_19, SquidInstr=merge_17, PPU=1, AA=True, autohide=False)
image_11 = Image(Bitmap=squid_17, Bounds=R_9, Interpolate=Slider(3, range=0..10))
squid_18 = Squid(BitmapR=R_9, SquidInstr=image_11, PPU=1, AA=True, autohide=False)

scale_22 = Scale(Geometry=move_33.Geometry, Center=Point(0, 0, 0), Factor=Slider(1.182, range=0..10))  # -> Geometry, Transform
runion_9 = RegionUnion(Curves=scale_22.Geometry)
draw_42 = Draw(Curve=runion_9, Accuracy=-1, Outline=outline_14)  # -> SquidInstr, Curve
move_44 = Move(Geometry=runion_9, Motion=vec_22.Vector)  # -> Geometry, Transform
draw_43 = Draw(Curve=move_44.Geometry, Accuracy=-1, Fill=ColourSwatch(SwatchColor=RGB(143, 143, 143)))  # -> SquidInstr, Curve

drawex_9 = DrawEx(Curves=scale_22.Geometry, Accuracy=Slider(10, range=0..10), Fill=filll_4.Fill, Mode=True)  # -> SquidInstr, Curve

geo_6 = Geometry(runion_9)
geo_7 = Geometry(runion_9)
draw_44 = Draw(Curve=geo_7, Accuracy=-1, Fill=ColourSwatch(SwatchColor=RGB(255, 255, 255)))  # -> SquidInstr, Curve
squid_19 = Squid(BitmapR=geo_5, SquidInstr=[clear_11, draw_44.SquidInstr], PPU=1, AA=True, autohide=False)
alpha = Alpha(Bitmap=squid_19, Bounds=geo_5, Interpolate=0)
squid_20 = Squid(BitmapR=geo_5, SquidInstr=[draw_27.SquidInstr, alpha], PPU=1, AA=True, autohide=False)
image_12 = Image(Bitmap=squid_20, Bounds=geo_5, Interpolate=0)

merge_18 = Merge(
    Data1=flatten(clear_9),
    Data2=flatten(draw_43.SquidInstr),
    Data4=flatten(drawex_9.SquidInstr),
    Data6=flatten(draw_42.SquidInstr))
squid_21 = Squid(BitmapR=rec_21, SquidInstr=merge_18, PPU=1, AA=True, autohide=False)
image_13 = Image(Bitmap=squid_21, Bounds=R_10, Interpolate=Slider(3, range=0..10))
squid_22 = Squid(BitmapR=R_10, SquidInstr=image_13, PPU=1, AA=True, autohide=False)

scale_23 = Scale(Geometry=move_35.Geometry, Center=Point(0, 0, 0), Factor=Slider(1.182, range=0..10))  # -> Geometry, Transform
runion_10 = RegionUnion(Curves=scale_23.Geometry)
draw_45 = Draw(Curve=runion_10, Accuracy=-1, Outline=outline_15)  # -> SquidInstr, Curve
move_45 = Move(Geometry=runion_10, Motion=vec_23.Vector)  # -> Geometry, Transform
draw_46 = Draw(Curve=move_45.Geometry, Accuracy=-1, Fill=ColourSwatch(SwatchColor=RGB(143, 143, 143)))  # -> SquidInstr, Curve

drawex_10 = DrawEx(Curves=scale_23.Geometry, Accuracy=Slider(10, range=0..10), Fill=ColourSwatch(SwatchColor=RGB(255, 255, 255)), Mode=True)  # -> SquidInstr, Curve

number_slider_11 = Slider(0.1, range=0..0.1)
swatch_14 = ColourSwatch(SwatchColor=RGB(255, 255, 255))
rec_24 = Rectangle({Plane=PlaneXY(30, 30, 0), Size=Domain2(u=0..165, v=0..200)})
rec_25 = Rectangle({Plane=PlaneXY(40, 10, 0), Size=Domain2(u=0..184, v=0..208)})
outlineex_14 = OutlineEx(Color=ColourSwatch(SwatchColor=RGB(0, 0, 0)), Width=1, LineJoin=0, StartCap=1, EndCap=1, Dash="10", DashCap=1)
R_18 = Bounds({Plane=PlaneXY(0, 0, 0), Size=Domain2(u=0..24, v=0..24)})

rint = RegionIntersection(CurvesA=move.Geometry, CurvesB=rec_24)
explode_5 = Explode(Curve=rint, Recursive=True)  # -> Segments, Vertices
len = Length(Curve=explode_5.Segments)
sort = SortList(Keys=len, ValuesA=explode_5.Segments)  # -> Keys, ValuesA
item = ListItem(List=reverse(sort.ValuesA), Index=0, Wrap=True)
end = EndPoints(Curve=item)  # -> Start, End
rdiff = RegionDifference(CurvesA=rec_24, CurvesB=move.Geometry)
rdiff_2 = RegionDifference(CurvesA=rec_25, CurvesB=pline)
pl = ConstructPlane(Origin=end.Start, XAxis=item, YAxis=Z)
mirror = Mirror(Geometry=rint, Plane=pl)  # -> Geometry, Transform
scale_24 = Scale(Geometry=mirror.Geometry, Center=Point(0, 0, 0), Factor=number_slider_11)  # -> Geometry, Transform
draw_47 = Draw(Curve=scale_24.Geometry, Accuracy=-1, Fill=ColourSwatch(SwatchColor=RGB(153, 153, 153)))  # -> SquidInstr, Curve

scale_25 = Scale(Geometry=rdiff_2, Center=Point(0, 0, 0), Factor=number_slider_11)  # -> Geometry, Transform
scale_26 = Scale(Geometry=rdiff, Center=Point(0, 0, 0), Factor=number_slider_11)  # -> Geometry, Transform
draw_48 = Draw(Curve=scale_25.Geometry, Accuracy=-1, Fill=ColourSwatch(SwatchColor=RGBA(0, 0, 0, 55)))  # -> SquidInstr, Curve
draw_49 = Draw(Curve=scale_26.Geometry, Accuracy=-1, Outline=outlineex_14, Fill=filll_2.Fill)  # -> SquidInstr, Curve
merge_19 = Merge(Data2=flatten(draw_48.SquidInstr), Data3=flatten(draw_49.SquidInstr), Data4=flatten(draw_47.SquidInstr))
merge_20 = Merge(Data2=flatten(merge_19), Data3=flatten(image_2))
squid_23 = Squid(BitmapR=R_18, SquidInstr=merge_20, PPU=1, AA=False, autohide=False)

number_slider_12 = Slider(0.1, range=0..0.1)
swatch_15 = ColourSwatch(SwatchColor=RGB(255, 255, 255))
rec_26 = Rectangle({Plane=PlaneXY(40, 10, 0), Size=Domain2(u=0..184, v=0..208)})
rec_27 = Rectangle({Plane=PlaneXY(30, 30, 0), Size=Domain2(u=0..165, v=0..200)})
outlineex_15 = OutlineEx(Color=ColourSwatch(SwatchColor=RGB(0, 0, 0)), Width=1, LineJoin=0, StartCap=1, EndCap=1, Dash="10", DashCap=1)
R_19 = Bounds({Plane=PlaneXY(0, 0, 0), Size=Domain2(u=0..24, v=0..24)})

rint_2 = RegionIntersection(CurvesA=move_2.Geometry, CurvesB=rec_27)
explode_6 = Explode(Curve=rint_2, Recursive=True)  # -> Segments, Vertices
len_2 = Length(Curve=explode_6.Segments)
sort_2 = SortList(Keys=len_2, ValuesA=explode_6.Segments)  # -> Keys, ValuesA
item_2 = ListItem(List=reverse(sort_2.ValuesA), Index=0, Wrap=True)
end_2 = EndPoints(Curve=item_2)  # -> Start, End
rdiff_3 = RegionDifference(CurvesA=rec_27, CurvesB=move_2.Geometry)
rdiff_4 = RegionDifference(CurvesA=rec_26, CurvesB=pline_3)
pl_2 = ConstructPlane(Origin=end_2.Start, XAxis=item_2, YAxis=Z_2)
mirror_2 = Mirror(Geometry=rint_2, Plane=pl_2)  # -> Geometry, Transform
scale_27 = Scale(Geometry=mirror_2.Geometry, Center=Point(0, 0, 0), Factor=number_slider_12)  # -> Geometry, Transform
draw_50 = Draw(Curve=scale_27.Geometry, Accuracy=-1, Fill=ColourSwatch(SwatchColor=RGB(153, 153, 153)))  # -> SquidInstr, Curve

scale_28 = Scale(Geometry=rdiff_4, Center=Point(0, 0, 0), Factor=number_slider_12)  # -> Geometry, Transform
scale_29 = Scale(Geometry=rdiff_3, Center=Point(0, 0, 0), Factor=number_slider_12)  # -> Geometry, Transform
draw_51 = Draw(Curve=scale_28.Geometry, Accuracy=-1, Fill=ColourSwatch(SwatchColor=RGBA(0, 0, 0, 55)))  # -> SquidInstr, Curve
draw_52 = Draw(Curve=scale_29.Geometry, Accuracy=-1, Outline=outlineex_15, Fill=filll_3.Fill)  # -> SquidInstr, Curve
merge_21 = Merge(Data2=flatten(draw_51.SquidInstr), Data3=flatten(draw_52.SquidInstr), Data4=flatten(draw_50.SquidInstr))
merge_22 = Merge(Data2=flatten(merge_21), Data3=flatten(draw_6.SquidInstr))
squid_24 = Squid(BitmapR=R_19, SquidInstr=merge_22, PPU=1, AA=False, autohide=False)

merge_23 = Merge(
    Data1=flatten(clear_10),
    Data2=flatten(draw_46.SquidInstr),
    Data4=flatten(drawex_10.SquidInstr),
    Data5=flatten(draw_45.SquidInstr))
squid_25 = Squid(BitmapR=rec_23, SquidInstr=merge_23, PPU=1, AA=True, autohide=False)
image_14 = Image(Bitmap=squid_25, Bounds=R_11, Interpolate=Slider(3, range=0..10))

merge_24 = Merge(Data1=flatten(image_14), Data2=reverse(draw_7.SquidInstr))

squid_26 = Squid(BitmapR=R_11, SquidInstr=merge_24, PPU=1, AA=True, autohide=False)

rec_28 = Rectangle({Plane=PlaneXY(0, 0, 0), Size=Domain2(u=0..240, v=0..240)})
pt_11 = PointXYZ(XComponent=Slider(0, range=-10..10), YComponent=Slider(0, range=-10..10), ZComponent=0, System=PlaneXY(0, 0, 0))
move_46 = Move(Geometry=rec_28, Motion=pt_11)  # -> Geometry, Transform
rec_29 = Rectangle(move_46.Geometry)
sqgrid_6 = Square(Plane=PlaneXY(10, 110, 0), Size=Slider(12, range=0..100), ExtentX=Slider(8, range=0..10), ExtentY=Slider(2, range=0..10))  # -> flatten(Cells), Points
lng_5 = ListLength(List=sqgrid_6.Cells)
random_5 = Random(Range=Domain(0, 1), Number=lng_5, Seed=2)
smaller_3 = SmallerThan(FirstNumber=Slider(0.25, range=0..1), SecondNumber=random_5)  # -> SmallerThan, OrEqualTo
scale_30 = Scale(Geometry=sqgrid_6.Cells, Center=Point(0, 0, 0), Factor=Slider(0.1, range=0..0.1))  # -> Geometry, Transform
explode_7 = Explode(Curve=scale_30.Geometry, Recursive=True)  # -> Segments, Vertices
dispatch_3 = Dispatch(List=scale_30.Geometry, DispatchPattern=smaller_3.SmallerThan)  # -> ListA, ListB
hull_5 = ConvexHull(Points=flatten(explode_7.Vertices), Plane=PlaneXY(0, 0, 0))  # -> Hull, HullZ, Indices
outline_17 = Outline(Color=RGB(0, 0, 0), Width=Slider(10, range=0..10))
swatch_16 = ColourSwatch(SwatchColor=RGB(255, 255, 255))
outlineex_16 = OutlineEx(
    Color=ColourSwatch(SwatchColor=RGB(0, 0, 0)),
    Width=Slider(2, range=0..10),
    LineJoin=1,
    StartCap=1,
    EndCap=1,
    Dash="1",
    DashCap=1)
draw_53 = Draw(Curve=dispatch_3.ListB, Accuracy=-1, Fill=ColourSwatch(SwatchColor=RGB(0, 0, 0)))  # -> SquidInstr, Curve
draw_54 = Draw(Curve=dispatch_3.ListA, Accuracy=-1, Fill=ColourSwatch(SwatchColor=RGB(255, 255, 255)))  # -> SquidInstr, Curve
scale_nu_5 = ScaleNU(Geometry=hull_5.Hull, Plane=PlaneXY(1, 11, 0), ScaleX=Slider(0.894, range=0..1), ScaleY=1, ScaleZ=1)  # -> Geometry, Transform
draw_55 = Draw(Curve=scale_nu_5.Geometry, Accuracy=-1, Outline=outlineex_16)  # -> SquidInstr, Curve
vec_36 = VectorXYZ(XComponent=Slider(24, range=-100..100), YComponent=Slider(-24, range=-100..100), ZComponent=0)  # -> Vector, Length
clear_12 = Clear(Color=ColourSwatch(SwatchColor=RGBA(255, 255, 255, 0)))
R_20 = Bounds({Plane=PlaneXY(0, 0, 0), Size=Domain2(u=0..24, v=0..24)})

rec_30 = Rectangle({Plane=PlaneXY(0, 0, 0), Size=Domain2(u=0..240, v=0..240)})
pt_12 = PointXYZ(XComponent=Slider(0, range=-10..10), YComponent=Slider(0, range=-10..10), ZComponent=0, System=PlaneXY(0, 0, 0))
move_47 = Move(Geometry=rec_30, Motion=pt_12)  # -> Geometry, Transform
rec_31 = Rectangle(move_47.Geometry)
sqgrid_7 = Square(Plane=PlaneXY(10, 110, 0), Size=Slider(12, range=0..100), ExtentX=Slider(8, range=0..10), ExtentY=Slider(2, range=0..10))  # -> flatten(Cells), Points
scale_31 = Scale(Geometry=sqgrid_7.Cells, Center=Point(0, 0, 0), Factor=Slider(0.1, range=0..0.1))  # -> Geometry, Transform
explode_8 = Explode(Curve=scale_31.Geometry, Recursive=True)  # -> Segments, Vertices
hull_6 = ConvexHull(Points=flatten(explode_8.Vertices), Plane=PlaneXY(0, 0, 0))  # -> Hull, HullZ, Indices
outline_18 = Outline(Color=RGB(0, 0, 0), Width=Slider(10, range=0..10))
outlineex_17 = OutlineEx(
    Color=ColourSwatch(SwatchColor=RGB(120, 120, 120)),
    Width=Slider(2, range=0..10),
    LineJoin=1,
    StartCap=1,
    EndCap=1,
    Dash="1",
    DashCap=1)
scale_nu_6 = ScaleNU(Geometry=hull_6.Hull, Plane=PlaneXY(1, 11, 0), ScaleX=Slider(0.894, range=0..1), ScaleY=1, ScaleZ=1)  # -> Geometry, Transform
draw_56 = Draw(Curve=scale_nu_6.Geometry, Accuracy=-1, Outline=outlineex_17)  # -> SquidInstr, Curve
vec_37 = VectorXYZ(XComponent=Slider(24, range=-100..100), YComponent=Slider(-24, range=-100..100), ZComponent=0)  # -> Vector, Length
clear_13 = Clear(Color=ColourSwatch(SwatchColor=RGBA(255, 255, 255, 0)))
R_21 = Bounds({Plane=PlaneXY(0, 0, 0), Size=Domain2(u=0..24, v=0..24)})

lng_6 = ListLength(List=scale_31.Geometry)
random_6 = Random(Range=Domain(0, 1), Number=lng_6, Seed=2)
hsl_3 = ColourHSL(Alpha=1, Hue=random_6, Saturation=1, Luminance=0.5)

circle_11 = Circle([{Plane=Plane(origin=(61, 119, 0), x=(0.4594229189, -0.8882176432, 0), y=(0.8882176432, 0.4594229189, 0)), Radius=32.64965543}, {Plane=Plane(origin=(119, 110, 0), x=(0.5754934062, -0.8178064193, 0), y=(0.8178064193, 0.5754934062, 0)), Radius=33.01514804}, {Plane=Plane(origin=(163, 113, 0), x=(0.3987261114, -0.9170700563, 0), y=(0.9170700563, 0.3987261114, 0)), Radius=25.07987241}, {Plane=Plane(origin=(141, 154, 0), x=(0.3896399908, -0.9209672511, 0), y=(0.9209672511, 0.3896399908, 0)), Radius=28.23118843}, {Plane=Plane(origin=(90, 142, 0), x=(0.7384854939, -0.674269364, 0), y=(0.674269364, 0.7384854939, 0)), Radius=31.144823}])
vec_38 = VectorXYZ(XComponent=Slider(-12, range=-100..100), YComponent=Slider(-24, range=-100..100), ZComponent=0)  # -> Vector, Length
move_48 = Move(Geometry=circle_11, Motion=vec_38.Vector)  # -> Geometry, Transform

circle_12 = Circle([{Plane=Plane(origin=(61, 119, 0), x=(0.4594229189, -0.8882176432, 0), y=(0.8882176432, 0.4594229189, 0)), Radius=32.64965543}, {Plane=Plane(origin=(119, 110, 0), x=(0.5754934062, -0.8178064193, 0), y=(0.8178064193, 0.5754934062, 0)), Radius=33.01514804}, {Plane=Plane(origin=(163, 113, 0), x=(0.3987261114, -0.9170700563, 0), y=(0.9170700563, 0.3987261114, 0)), Radius=25.07987241}, {Plane=Plane(origin=(141, 154, 0), x=(0.3896399908, -0.9209672511, 0), y=(0.9209672511, 0.3896399908, 0)), Radius=28.23118843}, {Plane=Plane(origin=(90, 142, 0), x=(0.7384854939, -0.674269364, 0), y=(0.674269364, 0.7384854939, 0)), Radius=31.144823}])
vec_39 = VectorXYZ(XComponent=Slider(-12, range=-100..100), YComponent=Slider(-24, range=-100..100), ZComponent=0)  # -> Vector, Length
move_49 = Move(Geometry=circle_12, Motion=vec_39.Vector)  # -> Geometry, Transform

scale_32 = Scale(Geometry=move_48.Geometry, Center=Point(0, 0, 0), Factor=Slider(1.182, range=0..10))  # -> Geometry, Transform
runion_11 = RegionUnion(Curves=scale_32.Geometry)
draw_57 = Draw(Curve=runion_11, Accuracy=-1, Outline=outline_17, Fill=ColourSwatch(SwatchColor=RGB(133, 133, 133)))  # -> SquidInstr, Curve
move_50 = Move(Geometry=runion_11, Motion=vec_36.Vector)  # -> Geometry, Transform
draw_58 = Draw(Curve=move_50.Geometry, Accuracy=-1, Fill=ColourSwatch(SwatchColor=RGB(143, 143, 143)))  # -> SquidInstr, Curve

drawex_11 = DrawEx(Curves=scale_32.Geometry, Accuracy=Slider(10, range=0..10), Mode=True)  # -> SquidInstr, Curve

merge_25 = Merge(
    Data1=flatten(clear_12),
    Data2=flatten(draw_58.SquidInstr),
    Data3=flatten(drawex_11.SquidInstr),
    Data4=flatten(draw_57.SquidInstr))
squid_27 = Squid(BitmapR=rec_29, SquidInstr=merge_25, PPU=1, AA=True, autohide=False)
image_15 = Image(Bitmap=squid_27, Bounds=R_20, Interpolate=Slider(3, range=0..10))
merge_26 = Merge(
    Data1=flatten(image_15),
    Data2=flatten(draw_55.SquidInstr),
    Data3=flatten(draw_54.SquidInstr),
    Data4=flatten(draw_53.SquidInstr))
squid_28 = Squid(BitmapR=R_20, SquidInstr=merge_26, PPU=1, AA=False, autohide=False)

R_22 = Bounds({Plane=PlaneXY(0, 0, 0), Size=Domain2(u=0..24, v=0..24)})
vec_40 = VectorXYZ(XComponent=0, YComponent=Slider(2.513, range=0..10), ZComponent=0)  # -> Vector, Length
move_51 = Move(Geometry=R_22, Motion=vec_40.Vector)  # -> Geometry, Transform
image_16 = Image(Bitmap=squid_28, Bounds=move_51.Geometry, Interpolate=Slider(3, range=0..10))
R_23 = Bounds({Plane=PlaneXY(0, 0, 0), Size=Domain2(u=0..24, v=0..24)})
merge_27 = Merge(Data1=flatten(image_16), Data2=flatten(draw_11.SquidInstr))
squid_29 = Squid(BitmapR=R_23, SquidInstr=merge_27, PPU=1, AA=False, autohide=False)

scale_33 = Scale(Geometry=move_49.Geometry, Center=Point(0, 0, 0), Factor=Slider(1.182, range=0..10))  # -> Geometry, Transform
runion_12 = RegionUnion(Curves=scale_33.Geometry)
draw_59 = Draw(Curve=scale_31.Geometry, Accuracy=-1, Fill=hsl_3)  # -> SquidInstr, Curve
draw_60 = Draw(Curve=runion_12, Accuracy=-1, Outline=outline_18, Fill=ColourSwatch(SwatchColor=RGB(255, 255, 255)))  # -> SquidInstr, Curve
move_52 = Move(Geometry=runion_12, Motion=vec_37.Vector)  # -> Geometry, Transform
draw_61 = Draw(Curve=move_52.Geometry, Accuracy=-1, Fill=ColourSwatch(SwatchColor=RGB(143, 143, 143)))  # -> SquidInstr, Curve

drawex_12 = DrawEx(Curves=scale_33.Geometry, Accuracy=Slider(10, range=0..10), Mode=True)  # -> SquidInstr, Curve

merge_28 = Merge(
    Data1=flatten(clear_13),
    Data2=flatten(draw_61.SquidInstr),
    Data3=flatten(drawex_12.SquidInstr),
    Data4=flatten(draw_60.SquidInstr))
squid_30 = Squid(BitmapR=rec_31, SquidInstr=merge_28, PPU=1, AA=True, autohide=False)
image_17 = Image(Bitmap=squid_30, Bounds=R_21, Interpolate=Slider(3, range=0..10))
merge_29 = Merge(Data1=flatten(image_17), Data2=flatten(draw_56.SquidInstr), Data3=flatten(draw_59.SquidInstr))
squid_31 = Squid(BitmapR=R_21, SquidInstr=merge_29, PPU=1, AA=False, autohide=False)

R_24 = Bounds({Plane=PlaneXY(0, 0, 0), Size=Domain2(u=0..24, v=0..24)})
vec_41 = VectorXYZ(XComponent=0, YComponent=Slider(2.513, range=0..10), ZComponent=0)  # -> Vector, Length
move_53 = Move(Geometry=R_24, Motion=vec_41.Vector)  # -> Geometry, Transform
image_18 = Image(Bitmap=squid_31, Bounds=move_53.Geometry, Interpolate=Slider(3, range=0..10))
R_25 = Bounds({Plane=PlaneXY(0, 0, 0), Size=Domain2(u=0..24, v=0..24)})
merge_30 = Merge(Data1=flatten(image_18), Data2=flatten(draw_12.SquidInstr))
squid_32 = Squid(BitmapR=R_25, SquidInstr=merge_30, PPU=1, AA=False, autohide=False)
