# Grasshopper definition Advanced scripting with Volvox.gh (Grasshopper 0.9.76)
# plug-ins: Volvox

about = About(PivotX=63, PivotY=229)

# ---- group: Opens up the http://data.duraark.eu website with publicly available point clouds and IFC models
# You can download some example .e57 files from here:
click_to_open_the_duraark_data_website = Button()

# ---- group: Generate point cloud
number_slider = Slider(50, range=0..100)
cgrid = CloudGrid(Plane=PlaneXY(0, 0, 0), Size=1, ExtentX=number_slider, ExtentY=number_slider, ExtentZ=number_slider)

# ---- group: Measure distance to the box
bbox = BoundingBox(Content=cgrid, Plane=PlaneXY(0, 0, 0))  # -> Box, Box_2
panel = Panel("BoxDistance")
scale = Scale(Geometry=bbox.Box, Center=Point(0, 0, 0), Factor=0.5)  # -> Geometry, Transform
mcompare = MeshCompare(Cloud=cgrid, Mesh=scale.Geometry, Key=panel)

# ---- group: Change colors according to BoxDistance
bounds = Bounds(Cloud=mcompare, Key=panel)
range = Range(Domain=bounds, Steps=10)
remap = RemapNumbers(Value=range, Source=bounds, Target=Domain(0, 1))  # -> Mapped, Clipped
gradient = Gradient(
    LowerLimit=0,
    UpperLimit=1,
    Parameter=remap.Mapped,
    stops=[0: RGB(243, 57, 0), 0.1: RGB(236, 27, 60), 0.2: RGB(210, 0, 118), 0.3: RGB(103, 0, 120), 0.4: RGB(39, 72, 161), 0.5: RGB(1, 192, 229), 0.6: RGB(18, 178, 90), 0.7: RGB(79, 186, 8), 0.8: RGB(220, 237, 32), 0.9: RGB(247, 159, 20), 1: RGB(243, 57, 0)])
prevdata = PreviewData(Cloud=mcompare, Key=panel, Values=range, Colors=gradient)

# ---- group: Cloud Script
vb_script = Panel("""'RGB to CMYK conversion
'Returning C value for each point in the cloud
'Calculating C, M, Y, K values as well (just as an example)

Dim Denominator as Double = 1/255

r *= Denominator
g *= Denominator
b *= Denominator

Dim Kv as double = 1-math.max(math.max(r,g),b)
Dim KDenom as Double = 1/(1-Kv)

Dim Cv as double = (1-r-kv) * KDenom
Dim Mv as double = (1-g-kv) * KDenom
Dim Yv as double = (1-b-kv) * KDenom

Return Cv""")
scrdata = CloudScript(Cloud=prevdata, Key="CMYKValues", Script=vb_script)  # -> Cloud, Script
vb_script_as_compiled = Panel(scrdata.Script)

# ---- group: Change colors according to CMYKValues
bounds_2 = Bounds(Cloud=scrdata.Cloud, Key="CMYKValues")
range_2 = Range(Domain=bounds_2, Steps=10)
remap_2 = RemapNumbers(Value=range_2, Source=bounds_2, Target=Domain(0, 1))  # -> Mapped, Clipped
gradient_2 = Gradient(LowerLimit=0, UpperLimit=1, Parameter=remap_2.Mapped, stops=[0: RGB(255, 255, 255), 1: RGB(0, 0, 0)])
prevdata_2 = PreviewData(Cloud=scrdata.Cloud, Key="CMYKValues", Values=range_2, Colors=gradient_2)

# ----
X = UnitX(Factor=120)
move = Move(Geometry=prevdata_2, Motion=X)  # -> Geometry, Transform
