# Grasshopper definition Basic Operations.gh (Grasshopper 0.9.76)
# plug-ins: Volvox

about = About(PivotX=45, PivotY=47)

# ----
# BoxCrop, PlaneCrop, SphereCrop
abort = Button()
run = Button()
F = FilePath("C:\Users\heve\Documents\_HenrikEvers\Duraark\Volvox\Examples\CITA_Deleuran_AAVisitingSchoolAarhus.e57")
loade57 = LoadE57(FilePath=F, Index=-1, Percent=1, Run=run, Abort=abort, Check=True)  # -> Cloud, Pose
brep = Brep(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)
abort_2 = Button()
pclip = PlaneClip(Plane=PlaneXY(0, 0, 0))
bcrop = BoxCrop(Box=brep)
run_2 = Button()
cloudx = CloudEngineX(Cloud=loade57.Cloud, Run=run_2, Abort=abort_2, Instruction0=bcrop, showinfo=True)

# ----
# Random Subsampling
abort_3 = Button()
run_3 = Button()
F_2 = FilePath("C:\Users\heve\Documents\_HenrikEvers\Duraark\Volvox\Examples\CITA_Deleuran_AAVisitingSchoolAarhus.e57")
loade57_2 = LoadE57(FilePath=F_2, Index=-1, Percent=1, Run=run_3, Abort=abort_3, Check=True)  # -> Cloud, Pose
rsub = RandomSubsampling(Percent=Slider(0.01, range=0..1), Seed=123)
abort_4 = Button()
run_4 = Button()
cloudx_2 = CloudEngineX(Cloud=loade57_2.Cloud, Run=run_4, Abort=abort_4, Instruction0=rsub, showinfo=True)
panel = Panel(cloudx_2)

# ----
# Transform
abort_5 = Button()
run_5 = Button()
F_3 = FilePath("C:\Users\heve\Documents\_HenrikEvers\Duraark\Volvox\Examples\CITA_Deleuran_AAVisitingSchoolAarhus.e57")
loade57_3 = LoadE57(FilePath=F_3, Index=-1, Percent=1, Run=run_5, Abort=abort_5, Check=True)  # -> Cloud, Pose
Z = UnitZ(Factor=Slider(1, range=0..10))
move = Move(Motion=Z)  # -> Geometry, Transform
orient = Orient(Source=PlaneXY(0, 0, 0), Target=PlaneXY(0, 0, 0))  # -> Geometry, Transform
rotate = Rotate(Angle=1.570796327, Plane=PlaneXY(0, 0, 0))  # -> Geometry, Transform
transform = Transform(Transformation=move.Transform)
abort_6 = Button()
run_6 = Button()
cloudx_3 = CloudEngineX(Cloud=loade57_3.Cloud, Run=run_6, Abort=abort_6, Instruction0=transform, showinfo=True)

# ---- group: sphere instruction
number_slider = Slider(0.5, range=0..1)
pt = Point(Point(0, 0, 0))
sph = Sphere(Base=pt, Radius=number_slider)
scrop = SphereCrop(Center=pt, Radius=number_slider)

# ----
# Voxel Subsampling
abort_7 = Button()
run_7 = Button()
F_4 = FilePath("C:\Users\heve\Documents\_HenrikEvers\Duraark\Volvox\Examples\CITA_Deleuran_AAVisitingSchoolAarhus.e57")
loade57_4 = LoadE57(FilePath=F_4, Index=-1, Percent=1, Run=run_7, Abort=abort_7, Check=True)  # -> Cloud, Pose
vsub = VoxelSubsampling(Size=Slider(0.005, range=0..1))
abort_8 = Button()
run_8 = Button()
cloudx_4 = CloudEngineX(Cloud=loade57_4.Cloud, Run=run_8, Abort=abort_8, Instruction0=vsub, showinfo=True)
panel_2 = Panel(cloudx_4)
