# Grasshopper definition Clipping planes.gh (Grasshopper 0.9.76)
# plug-ins: Volvox

about = About(PivotX=49, PivotY=229)

# ---- group: Opens up the http://data.duraark.eu website with publicly available point clouds and IFC models
# You can download some example .e57 files from here:
click_to_open_the_duraark_data_website = Button()

# ----
# You can download this point cloud from the libe57.org test data site.
# 
# data.duraark.eu is another website with examples of point clouds (much more examples to find there)
# 
# http://data.duraark.eu/
# http://www.libe57.org/data.html
path = FilePath("C:\Mateusz\DURAARK\PointClouds\Station018.e57")
loade57 = LoadE57(FilePath=path, Index=-1, Percent=1, Run=Button(), Abort=Button(), Check=False)  # -> Cloud, Pose
orient = Orient(Geometry=loade57.Cloud, Source=loade57.Pose, Target=PlaneXY(0, 0, 0))  # -> Geometry, Transform

# ----
# This is a highly experimental component which tries
# to tie Rhino Clipping planes with Grasshopper.
box = Box({Plane=PlaneXY(-23.2418203, -31.6026888, 0), X=Domain(0, 19.5983929), Y=Domain(0, 14.95538259), Z=Domain(0, 13.50926458)})
clipplane = ClippingPlane(
    ConvexBrep=box,
    Plane0=Plane(origin=(-13.44262385, -31.6026888, 6.754632289), x=(0, 0, 1), y=(1, 0, 0)),
    Plane1=Plane(origin=(-3.643427397, -24.1249975, 6.754632289), x=(0, 0, 1), y=(0, 1, 0)),
    Plane2=Plane(origin=(-13.44262385, -16.64730621, 6.754632289), x=(0, 0, 1), y=(-1, 0, 0)),
    Plane3=Plane(origin=(-23.2418203, -24.1249975, 6.754632289), x=(0, 0, 1), y=(0, -1, 0)),
    Plane4=PlaneXY(-13.44262385, -24.1249975, 0),
    Plane5=Plane(origin=(-13.44262385, -24.1249975, 13.50926458), x=(0, 1, 0), y=(1, 0, 0)))
