# Grasshopper definition EngineX vs Engine.gh (Grasshopper 0.9.76)
# plug-ins: Volvox

about = About(PivotX=48, PivotY=230)

# ---- group: Opens up the http://data.duraark.eu website with publicly available point clouds and IFC models
# You can download some example .e57 files from here:
click_to_open_the_duraark_data_website = Button()

# ----
number_slider = Slider(100, range=0..100)

rsub = RandomSubsampling(Percent=Slider(0.01, range=0..0.1), Seed=123)

cgrid = CloudGrid(Plane=PlaneXY(0, 0, 0), Size=1, ExtentX=number_slider, ExtentY=number_slider, ExtentZ=number_slider)

# ---- group: Computation won't start until you click the Run button.
run = Button()
abort = Button()

# ----
cloude = CloudEngine(Cloud=cgrid, Instruction0=rsub)
cloudx = CloudEngineX(Cloud=cgrid, Run=run, Abort=abort, Instruction0=rsub, showinfo=True)
