# Grasshopper definition Expression Dictionary.gh (Grasshopper 0.9.76)
# plug-ins: Volvox

about = About(PivotX=58, PivotY=49)

# ----
# Height Expression
abort = Button()
run = Button()
F = FilePath("C:\Users\heve\Documents\_HenrikEvers\Duraark\Volvox\Examples\CITA_Deleuran_AAVisitingSchoolAarhus.e57")
loade57 = LoadE57(FilePath=F, Index=-1, Percent=1, Run=run, Abort=abort, Check=True)  # -> Cloud, Pose
expdata = CloudExpression(C=loade57.Cloud, K="Z coord", E="z")
bounds = Bounds(Cloud=expdata, Key="Z coord")
keylist = ListKeys(Cloud=expdata)
panel = Panel(keylist)
div = DivideDomain(Domain=bounds, Count=4)
dedomain = DeconstructDomain(Domain=div)  # -> Start, End
item = ListItem(List=dedomain.End, Index=-1, Wrap=True)
range = Range(Domain=Domain(0, 0.7), Steps=4)

# ----
# Heart Expression
panel_2 = Panel("(x^2 + (9*y^2)/4 + z^2 - 1)^3 - x^2*z^3 -((9*(y^2)*(z^3))/80)")
number_slider = Slider(100, range=0..100)
cgrid = CloudGrid(
    Plane="-1.5,-1.5,-1.2",
    Size=Slider(0.03, range=0..1),
    ExtentX=number_slider,
    ExtentY=number_slider,
    ExtentZ=number_slider)
number_slider_2 = Slider(6, range=0..10)
expdata_2 = CloudExpression(C=cgrid, K="MyEquation", E=panel_2)
cullc = CullCloud(Cloud=expdata_2, Key="MyEquation", Domain=" -100 to 0")
scale = Scale(Geometry=cgrid, Center=Point(0, 0, 0), Factor=number_slider_2)  # -> Geometry, Transform
scale_2 = Scale(Geometry=cullc, Center=Point(0, 0, 0), Factor=number_slider_2)  # -> Geometry, Transform
preview = CustomPreview(Geometry=scale.Geometry, Shader=ColourSwatch(SwatchColor=RGB(87, 87, 87)))
expdata_3 = CloudExpression(C=scale_2.Geometry, K="MyEquation2", E="sin(x)*cos(y) + sin(y)*cos(z)+sin(z)*cos(x)")
bounds_2 = Bounds(Cloud=expdata_3, Key="MyEquation2")
range_2 = Range(Domain=bounds_2, Steps=10)
gradient = Gradient(LowerLimit=0, UpperLimit=1, Parameter=range_2, stops=[0: RGB(191, 255, 0), 1: RGB(0, 0, 0)])
prevdata = PreviewData(Cloud=expdata_3, Key="MyEquation2", Values=range_2, Colors=gradient)

# ----
# Expression Dictionary
panel_3 = Panel("2*y*(y^2-3*x^2)*(1-z^2)+(x^2+y*2)^2-(9*z^2-1)*(1-z^2)")
number_slider_3 = Slider(100, range=0..400)
cgrid_2 = CloudGrid(
    Plane="-10,-10,-10",
    Size=Slider(0.2, range=0..1),
    ExtentX=number_slider_3,
    ExtentY=number_slider_3,
    ExtentZ=number_slider_3)
dom = ConstructDomain(DomainStart=Slider(4390, range=-100000..100000), DomainEnd=Slider(8460, range=-100000..100000))
expdata_4 = CloudExpression(C=cgrid_2, K="eq", E=panel_3)
cullc_2 = CullCloud(Cloud=expdata_4, Key="eq", Domain=dom)

# ---- group: Color by Dictionary
hsl = ColourHSL(Alpha=1, Hue=range, Saturation=1, Luminance=0.5)  # -> reverse(Colour)
merge = Merge(Data1=dedomain.Start, Data2=item)
prevdata_2 = PreviewData(Cloud=expdata, Key="Z coord", Values=merge, Colors=hsl)

# ---- group: Cull by Dictionary
dedomain_2 = DeconstructDomain(Domain=bounds)  # -> Start, End
dom_2 = ConstructDomain(DomainStart=dedomain_2.Start, DomainEnd=Slider(0.1, range=0..1))
cullc_3 = CullCloud(Cloud=prevdata_2, Key="Z coord", Domain=dom_2)

# ----
# Depth Expression
abort_2 = Button()
run_2 = Button()
F_2 = FilePath("C:\Users\heve\Documents\_HenrikEvers\Duraark\Volvox\Examples\CITA_Deleuran_AAVisitingSchoolAarhus.e57")
loade57_2 = LoadE57(FilePath=F_2, Index=-1, Percent=1, Run=run_2, Abort=abort_2, Check=True)  # -> Cloud, Pose
expdata_5 = CloudExpression(C=loade57_2.Cloud, K="Intensity", E="x*x+y*y+z*z")
bounds_3 = Bounds(Cloud=expdata_5, Key="Intensity")
dedomain_3 = DeconstructDomain(Domain=bounds_3)  # -> Start, End
bnd = Bounds(Numbers=[dedomain_3.Start, dedomain_3.End])
dedomain_4 = DeconstructDomain(Domain=bnd)  # -> Start, End
merge_2 = Merge(Data1=ColourSwatch(SwatchColor=RGB(0, 0, 0)), Data2=ColourSwatch(SwatchColor=RGB(255, 255, 255)))
merge_3 = Merge(Data1=dedomain_4.Start, Data2=dedomain_4.End)
prevdata_3 = PreviewData(Cloud=expdata_5, Key="Intensity", Values=merge_3, Colors=merge_2)
