# Grasshopper definition Load E57.gh (Grasshopper 0.9.76)
# plug-ins: Volvox

about = About(PivotX=46, PivotY=229)

# ---- group: Opens up the http://data.duraark.eu website with publicly available point clouds and IFC models
# You can download some example .e57 files from here:
click_to_open_the_duraark_data_website = Button()
vb_script = VBScript(DURAARK_Data=click_to_open_the_duraark_data_website)
# ---------- vb_script: VB ----------
    If DuraArk_Data Then
      Dim OpenWebsite As system.Diagnostics.Process = system.Diagnostics.Process.Start("http://data.duraark.eu/")
      OpenWebsite.Dispose 
    End If
# ---------- end vb_script ----------

# ----
amount_of_points_to_load_0_to_1 = Slider(1, range=0..1)

# ---- group: If there is more than one scan in the file, you can also specify which scans to load.
panel = Panel("""0
1
2
3""")

# ----
abort_loading = Button()
load = Button()
path = FilePath("C:\Mateusz\DURAARK\PointClouds\pumpAGroupByLineRowColumnIndex.e57")

# ---- group: Gives all the file metadata
e57meta = E57Metadata(FilePath=path)  # -> FormatName, FileGuid, VersionMajor, VersionMinor, LibraryVersion, Date, Metadata, Scans, Poses, ScanCount
number_of_scans_in_the_file = Panel(e57meta.ScanCount)

# ---- group: Loads just the points and scanner positions
loade57 = LoadE57(FilePath=path, Index=-1, Percent=amount_of_points_to_load_0_to_1, Run=load, Abort=abort_loading, Check=True)  # -> Cloud, Pose

# ---- group: Loads scans with all the associated metadata
load_2 = Button()
abort_loading_2 = Button()
loade57ex = LoadE57Ex(FilePath=path, Index=-1, Percent=Slider(1, range=0..1), Run=load_2, Abort=abort_loading_2, Check=True)  # -> Cloud, Pose, Guid, Name, Description, CartesianB, SphericalB, ColorB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
