# Grasshopper definition LoadAndSave.gh (Grasshopper 0.9.76)
# plug-ins: Volvox

about = About(PivotX=44, PivotY=231)

# ---- group: Opens up the http://data.duraark.eu website with publicly available point clouds and IFC models
# You can download some example .e57 files from here:
click_to_open_the_duraark_data_website = Button()

# ----
panel = Panel("C:\Mateusz\DURAARK\PointClouds\Plan3D_Intensity_Subsampled.e57")

# ---- group: Load, Subsample, Save
load_e57 = LoadE57(FilePath="C:\Mateusz\DURAARK\PointClouds\Plan3D_Intensity.e57", Percent=1, Check=True)
vsub = VoxelSubsampling(Size=Slider(0.5, range=0..1))
# Thanks to the new Saving components,
# it's now possible to Save files with the engine.
save_e57 = SaveE57(FilePath=panel)

# ----
cloudx = CloudEngineX(Cloud=load_e57, Run=Button(), Abort=False, Instruction0=vsub, Instruction1=save_e57, showinfo=True)
