# Grasshopper definition Scanner Position.gh (Grasshopper 0.9.76)
# plug-ins: Volvox

about = About(PivotX=52, PivotY=231)

# ---- group: Opens up the http://data.duraark.eu website with publicly available point clouds and IFC models
# You can download some example .e57 files from here:
click_to_open_the_duraark_data_website = Button()

# ----
# You can download this point cloud from the libe57.org test data site.
# 
# data.duraark.eu is another website with examples of point clouds (much more examples to find there)
# 
# http://data.duraark.eu/
# http://www.libe57.org/data.html
path = FilePath("C:\Mateusz\DURAARK\PointClouds\Station018.e57")
loade57 = LoadE57(FilePath=path, Index=-1, Percent=1, Run=Button(), Abort=Button(), Check=False)  # -> Cloud, Pose

# ---- group: Once you set the scanner position, it persists downstream...
set_pose = SetPosition(Cloud=loade57.Cloud, Position=loade57.Pose)

# ---- group: ...so transforming the cloud transforms the position as well.
move = Move(Geometry=set_pose, Motion=Vector(0, 0, 10))  # -> Geometry, Transform

# ----
xy = XYPlane(Origin=Point(0, 0, 0))
getpose = GetPosition(Cloud=move.Geometry)

# ---- group: You can use the scanner position to orient the point cloud nicely.
orient = Orient(Geometry=move.Geometry, Source=getpose, Target=xy)  # -> Geometry, Transform
