# Grasshopper definition Selection.gh (Grasshopper 0.9.76)
# plug-ins: Volvox

about = About(PivotX=49, PivotY=229)

# ---- group: Opens up the http://data.duraark.eu website with publicly available point clouds and IFC models
# You can download some example .e57 files from here:
click_to_open_the_duraark_data_website = Button()

# ----
number_slider = Slider(50, range=0..100)
cgrid = CloudGrid(Plane=PlaneXY(0, 0, 0), Size=1, ExtentX=number_slider, ExtentY=number_slider, ExtentZ=number_slider)

# ---- group: Switch to leave points outside/inside the mesh
toggle = BooleanToggle(False)

# ---- group: Double click to create selection mesh in Rhino
selection = Selection(
    BoundingBox=cgrid,
    line_0=Line((-15.88433838, 2.076408148, 44.31978989), (-11.98973465, 5.402628899, 56.15520859)),
    line_1=Line((-15.88433838, 2.076408148, 44.31978989), (-2.763178825, -13.28689098, 44.31978989)),
    line_10=Line((68.30405426, 82.89676666, 8.381671906), (88.60454559, 59.12733459, 8.381679535)),
    line_11=Line((82.57897949, 53.98113251, -9.92957592), (88.60454559, 59.12733459, 8.381679535)),
    line_12=Line((-36.69513321, 73.40200806, 21.49589729), (-32.43886566, 67.67079926, 41.32489777)),
    line_13=Line((-36.69513321, 73.40200806, 21.49589729), (-14.30173016, 90.03237915, 21.4958992)),
    line_14=Line((-36.69513321, 73.40200806, 21.49589729), (47.4838562, -34.48389435, -5.841807365)),
    line_15=Line((-32.43886566, 67.67079926, 41.32489777), (-10.04546928, 84.30116272, 41.32489777)),
    line_16=Line((-32.43886566, 67.67079926, 41.32489777), (49.90146255, -37.73928833, 5.421290874)),
    line_17=Line((-14.30173016, 90.03237915, 21.4958992), (-10.04546928, 84.30116272, 41.32489777)),
    line_18=Line((-14.30173016, 90.03237915, 21.4958992), (60.2035675, -25.03765106, -5.841807365)),
    line_19=Line((-10.04546928, 84.30116272, 41.32489777), (62.62117386, -28.29304695, 5.421290874)),
    line_2=Line((-15.88433838, 2.076408148, 44.31978989), (62.27848434, 77.7505722, -9.929577827)),
    line_20=Line((47.4838562, -34.48389435, -5.841807365), (49.90146255, -37.73928833, 5.421290874)),
    line_21=Line((47.4838562, -34.48389435, -5.841807365), (60.2035675, -25.03765106, -5.841807365)),
    line_22=Line((49.90146255, -37.73928833, 5.421290874), (62.62117386, -28.29304695, 5.421290874)),
    line_23=Line((60.2035675, -25.03765106, -5.841807365), (62.62117386, -28.29304695, 5.421290874)),
    line_24=Line((-35.96735001, 18.19815445, 16.94708252), (-27.76702881, 19.67351913, -8.695857048)),
    line_25=Line((-35.96735001, 18.19815445, 16.94708252), (-24.04920959, -48.04491806, 16.94708252)),
    line_26=Line((-35.96735001, 18.19815445, 16.94708252), (79.19206238, 33.3694725, 58.58568954)),
    line_27=Line((-27.76702881, 19.67351913, -8.695857048), (-15.8488884, -46.56955338, -8.695857048)),
    line_28=Line((-27.76702881, 19.67351913, -8.695857048), (84.11972046, 34.25603104, 43.17658615)),
    line_29=Line((-24.04920959, -48.04491806, 16.94708252), (-15.8488884, -46.56955338, -8.695857048)),
    line_3=Line((-11.98973465, 5.402628899, 56.15520859), (1.131425381, -9.960670471, 56.15520859)),
    line_30=Line((-24.04920959, -48.04491806, 16.94708252), (86.35379791, -6.436666965, 58.58568954)),
    line_31=Line((-15.8488884, -46.56955338, -8.695857048), (91.28145599, -5.550106049, 43.17658615)),
    line_32=Line((79.19206238, 33.3694725, 58.58568954), (84.11972046, 34.25603104, 43.17658615)),
    line_33=Line((79.19206238, 33.3694725, 58.58568954), (86.35379791, -6.436666965, 58.58568954)),
    line_34=Line((84.11972046, 34.25603104, 43.17658615), (91.28145599, -5.550106049, 43.17658615)),
    line_35=Line((86.35379791, -6.436666965, 58.58568954), (91.28145599, -5.550106049, 43.17658615))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)

# ---- group: Cull point outside/inside of the mesh
minclude = MeshInclude(Cloud=cgrid, Mesh=selection, Leave=toggle)
