# Grasshopper definition UserData.gh (Grasshopper 0.9.76)
# plug-ins: Volvox

about = About(PivotX=55, PivotY=230)

# ---- group: Opens up the http://data.duraark.eu website with publicly available point clouds and IFC models
# You can download some example .e57 files from here:
click_to_open_the_duraark_data_website = Button()

# ---- group: Creating cloud and coloring it according to expression / Create 1,000,000 points in a 3d grid
number_slider = Slider(100, range=0..100)
cgrid = CloudGrid(Plane=PlaneXY(0, 0, 0), Size=1, ExtentX=number_slider, ExtentY=number_slider, ExtentZ=number_slider)

# ---- group: Creating cloud and coloring it according to expression / Expression (just like in the expression component)
expression = Panel("sin(x/10) + cos(y/10) + sin(z/10)")

# ---- group: Culling points according to their colors / Expression (just like in the expression component)
you_can_use_x_y_z_a_r_g_b_u_v_w_coordina = Panel("If(x<=50, r+g+b, r-g)")  # "you can use X Y Z A R G B U V W (coordinates, intensity, color, normal)"

# ---- group: Culling points according to their colors
data_name = Panel("r value")
dom = ConstructDomain(DomainStart=Slider(101, range=0..765), DomainEnd=Slider(348, range=0..765))

# ---- group: Creating cloud and coloring it according to expression
data_name_2 = Panel("color")

# ---- group: Calculates the expression for each point in the point cloud / and then stores the values as custom User Data
expdata = CloudExpression(C=cgrid, K=data_name_2, E=expression)

# ---- group: Creating cloud and coloring it according to expression / Data bounds
bounds = Bounds(Cloud=expdata, Key=data_name_2)

# ---- group: Creating cloud and coloring it according to expression (continued)
range = Range(Domain=bounds, Steps=10)
dedomain = DeconstructDomain(Domain=bounds)  # -> Start, End
data_bounds = Panel(bounds)
gradient = Gradient(
    LowerLimit=dedomain.Start,
    UpperLimit=dedomain.End,
    Parameter=range,
    stops=[0: RGB(243, 57, 0), 0.1: RGB(236, 27, 60), 0.2: RGB(210, 0, 118), 0.3: RGB(103, 0, 120), 0.4: RGB(39, 72, 161), 0.5: RGB(1, 192, 229), 0.6: RGB(18, 178, 90), 0.7: RGB(79, 186, 8), 0.8: RGB(220, 237, 32), 0.9: RGB(247, 159, 20), 1: RGB(243, 57, 0)])

# ---- group: Creating cloud and coloring it according to expression / Colors the cloud based on the User Data values
prevdata = PreviewData(Cloud=expdata, Key=data_name_2, Values=range, Colors=gradient)

# ---- group: Culling points according to their colors / Adding another User Data
expdata_2 = CloudExpression(C=prevdata, K=data_name, E=you_can_use_x_y_z_a_r_g_b_u_v_w_coordina)

# ---- group: Culling points according to their colors / Cull the points according to User Data values and a domain
cullc = CullCloud(Cloud=expdata_2, Key=data_name, Domain=dom)
